# Grasshopper definition 04.gh (Grasshopper 1.0.8)

series = Series(Start=0, Step=Slider(12, range=0..100), Count=10)
construct_point = ConstructPoint(XCoordinate=Slider(173, range=0..1000), YCoordinate=0, ZCoordinate=0)
xz_plane = XZPlane(Origin=Point(0, 0, 0))
construct_point_2 = ConstructPoint(XCoordinate=Slider(121, range=0..1000), YCoordinate=Slider(237, range=0..1000), ZCoordinate=0)
series_2 = Series(Start=0, Step=Slider(12, range=0..100), Count=10)
unit_y = UnitY(Factor=series)
rectangle = Rectangle(Plane=xz_plane, XSize=Slider(12, range=0..100), YSize=Slider(12, range=0..100), Radius=0)  # -> Rectangle, Length
series_3 = Series(Start=0, Step=Slider(12, range=0..100), Count=10)
expression = Expression(x=series_2, Expression="x*cos(x)")
expression_2 = Expression(x=series_2, Expression="x*sin(x)")
xz_plane_2 = XZPlane(Origin=construct_point)
series_4 = Series(Start=0, Step=Slider(12, range=0..100), Count=10)
xz_plane_3 = XZPlane(Origin=construct_point_2)
move = Move(Geometry=rectangle.Rectangle, Motion=unit_y)  # -> Geometry, Transform
unit_y_2 = UnitY(Factor=series_3)
rectangle_2 = Rectangle(Plane=xz_plane_2, XSize=Slider(37, range=0..100), YSize=Slider(25, range=0..100), Radius=0)  # -> Rectangle, Length
unit_y_3 = UnitY(Factor=series_4)
rectangle_3 = Rectangle(Plane=xz_plane_3, XSize=Slider(37, range=0..100), YSize=Slider(25, range=0..100), Radius=0)  # -> Rectangle, Length
construct_point_3 = ConstructPoint(XCoordinate=expression_2, YCoordinate=expression, ZCoordinate=0)
move_2 = Move(Geometry=rectangle_2.Rectangle, Motion=unit_y_2)  # -> Geometry, Transform
move_3 = Move(Geometry=rectangle_3.Rectangle, Motion=unit_y_3)  # -> Geometry, Transform
area = Area(Geometry=move.Geometry)  # -> Area, Centroid
interpolate = Interpolate(Vertices=construct_point_3, Degree=3, Periodic=False, KnotStyle=1)  # -> Curve, Length, Domain
perp_frames = PerpFrames(Curve=interpolate.Curve, Count=10, Align=True)  # -> Frames, Parameters
orient = Orient(Geometry=move.Geometry, Source=area.Centroid, Target=perp_frames.Frames)  # -> Geometry, Transform
area_2 = Area(Geometry=orient.Geometry)  # -> Area, Centroid
deconstruct_plane = DeconstructPlane(Plane=perp_frames.Frames)  # -> Origin, XAxis, YAxis, ZAxis

negative = Negative(Value=Slider(4.6, range=0..10))
teethxc = CSharpScript(rect=rectangle_3.Rectangle, divisions=Slider(4, range=0..10), spacing=Slider(3.4, range=0..10), subLength=negative)  # -> out, A, B, C; inputs rect: Rectangle3d, divisions: Int32, spacing: Double, subLength: Double
# ---------- teethxc: C# ----------
using System;
using System.Collections.Generic;
using Rhino;
using Rhino.Geometry;
using Grasshopper.Kernel;

// The Script_Instance class defines a custom script for digital fabrication.
// It creates "teeth" along selected edges of a rectangle and bridges them with arcs.
// This is useful for generating complex boundaries or joints in digital fabrication workflows.
public class Script_Instance : GH_ScriptInstance
{
  /// <summary>
  /// The main method executed when the script runs.
  /// It takes a rectangle, divides its top and bottom edges into segments,
  /// generates protruding teeth along these segments, and then builds a composite boundary.
  /// Outputs:
  ///   A: The final composite boundary curve.
  ///   B: The list of curves for the top teeth.
  ///   C: The list of curves for the bottom teeth.
  /// </summary>
  private void RunScript(
		Rectangle3d rect,
		int divisions,
		double spacing,
		double subLength,
		ref object A,
		ref object B,
		ref object C)
  {
    // Ensure that the number of divisions is at least one.
    divisions = Math.Max(divisions, 1);
    
    // Extract the four corners of the rectangle.
    Point3d ptA = rect.Corner(0); // Typically the top-left corner.
    Point3d ptB = rect.Corner(1); // Top-right corner.
    Point3d ptC = rect.Corner(2); // Bottom-right corner.
    Point3d ptD = rect.Corner(3); // Bottom-left corner.
    Point3d rectCenter = rect.Center; // The center of the rectangle.

    // Calculate the inward vectors for the top and bottom edges.
    // The inward vector is determined by the direction from the edge’s midpoint to the rectangle's center.
    Vector3d topInward = GetInwardVector(ptA, ptB, rectCenter);
    Vector3d botInward = GetInwardVector(ptC, ptD, rectCenter);

    // Create teeth along the top and bottom edges.
    // Each tooth is created by dividing the edge into segments and then generating three line segments:
    // left side, tip, and right side.
    List<LineCurve> teethTop = Create3EdgeTeeth(ptA, ptB, divisions, spacing, subLength, topInward);
    List<LineCurve> teethBot = Create3EdgeTeeth(ptC, ptD, divisions, spacing, subLength, botInward);

    // Build composite curves for the top and bottom edges.
    // This function combines the teeth segments with connecting arcs to form a continuous edge.
    PolyCurve compTop = BuildCompositeEdge(ptA, ptB, teethTop, topInward);
    PolyCurve compBot = BuildCompositeEdge(ptC, ptD, teethBot, botInward);

    // Construct the final boundary curve by combining:
    // - The composite top edge,
    // - A straight line from the top-right to the bottom-right corner,
    // - The composite bottom edge,
    // - A straight line from the bottom-left back to the top-left corner.
    PolyCurve finalBoundary = new PolyCurve();
    finalBoundary.Append(compTop);
    finalBoundary.Append(new LineCurve(ptB, ptC));
    finalBoundary.Append(compBot);
    finalBoundary.Append(new LineCurve(ptD, ptA));
    // Close the polycurve to form a continuous loop.
    finalBoundary.MakeClosed(RhinoMath.ZeroTolerance);

    // Output the final boundary and the individual teeth curves.
    A = finalBoundary; // The complete boundary with arcs and teeth.
    B = teethTop;      // The list of top edge teeth.
    C = teethBot;      // The list of bottom edge teeth.
  }

  /// <summary>
  /// Computes an inward pointing vector relative to a given edge.
  /// The vector is determined by subtracting the midpoint of the edge from the rectangle's center.
  /// A fallback method is provided in case the vector is too small to be unitized.
  /// </summary>
  private Vector3d GetInwardVector(Point3d start, Point3d end, Point3d center)
  {
    // Calculate the vector from the midpoint of the edge to the center.
    Vector3d inward = center - (start + end) / 2.0;
    // Try to normalize the vector.
    if (!inward.Unitize())
    {
      // If normalization fails (e.g., the vector is nearly zero),
      // use the cross product of the edge direction with the Z-axis as a fallback.
      Vector3d edgeDir = end - start;
      if (edgeDir.Unitize())
        inward = Vector3d.CrossProduct(edgeDir, Vector3d.ZAxis);
      else
        inward = Vector3d.YAxis; // Default to the Y-axis if all else fails.
    }
    return inward;
  }

  /// <summary>
  /// Creates teeth along a specified edge by dividing it into segments.
  /// Each tooth is made up of three line segments:
  /// - Left side: from the base start to the tooth tip start.
  /// - Tip: the top edge connecting the two tip points.
  /// - Right side: from the tooth tip end to the base end.
  /// </summary>
  private List<LineCurve> Create3EdgeTeeth(Point3d start, Point3d end, 
                                         int divisions, double spacing, 
                                         double subLength, Vector3d inward)
  {
    List<LineCurve> teeth = new List<LineCurve>();
    // Divide the edge into evenly spaced points.
    List<Point3d> pts = DivideEdge(start, end, divisions);

    // Iterate through each segment of the divided edge.
    for (int i = 0; i < divisions; i++)
    {
      // Define the start and end of the current segment.
      Point3d segStart = pts[i];
      Point3d segEnd = pts[i + 1];
      
      // Determine the direction of the segment.
      Vector3d edgeDir = segEnd - segStart;
      if (!edgeDir.Unitize()) continue; // Skip if the segment is invalid.

      // Adjust the segment by a spacing factor to create a base for the tooth.
      Point3d baseStart = segStart + edgeDir * (spacing / 2);
      Point3d baseEnd = segEnd - edgeDir * (spacing / 2);
      
      // Calculate the tip positions of the tooth by projecting the base points inward.
      Point3d tipStart = baseStart + inward * subLength;
      Point3d tipEnd = baseEnd + inward * subLength;
      
      // Create the three edges of the tooth:
      // Left edge: from baseStart to tipStart.
      teeth.Add(new LineCurve(baseStart, tipStart));
      // Tip edge: from tipStart to tipEnd.
      teeth.Add(new LineCurve(tipStart, tipEnd));
      // Right edge: from tipEnd to baseEnd.
      teeth.Add(new LineCurve(tipEnd, baseEnd));
    }
    return teeth;
  }

  /// <summary>
  /// Builds a composite edge curve by combining the teeth segments with connecting arcs.
  /// The resulting polycurve starts at the provided start point, includes all teeth with arcs between them,
  /// and ends at the provided end point.
  /// </summary>
  private PolyCurve BuildCompositeEdge(Point3d startPt, Point3d endPt, 
                                      List<LineCurve> teeth, Vector3d inward)
  {
    PolyCurve composite = new PolyCurve();
    // If there are no teeth, simply create a straight line between start and end.
    if (teeth.Count == 0)
    {
      composite.Append(new LineCurve(startPt, endPt));
      return composite;
    }

    // Connect the starting point to the beginning of the first tooth with an arc.
    composite.Append(CreateArc(startPt, teeth[0].PointAtStart, inward));

    // Iterate over the teeth in groups of three (each tooth is made of three segments).
    for (int i = 0; i < teeth.Count; i += 3)
    {
      // Append the three segments for the current tooth.
      composite.Append(teeth[i]);     // Left edge of the tooth.
      composite.Append(teeth[i + 1]); // Tip edge.
      composite.Append(teeth[i + 2]); // Right edge.
      
      // If another tooth exists, bridge the current tooth to the next one with an arc.
      if (i < teeth.Count - 3)
      {
        composite.Append(CreateArc(
          teeth[i + 2].PointAtEnd, // End of current tooth.
          teeth[i + 3].PointAtStart, // Start of the next tooth.
          inward
        ));
      }
    }

    // Connect the end of the last tooth to the overall end point with an arc.
    composite.Append(CreateArc(
      teeth[teeth.Count - 1].PointAtEnd,
      endPt,
      inward
    ));

    return composite;
  }

  /// <summary>
  /// Creates an arc curve between two points.
  /// The arc's curvature is defined by an "inward" vector which offsets the midpoint.
  /// If the two points are too close or if the arc is invalid, a straight line is returned instead.
  /// </summary>
  private Curve CreateArc(Point3d start, Point3d end, Vector3d inward)
  {
    // If the start and end points are nearly identical, return a straight line.
    if (start.DistanceTo(end) < RhinoMath.ZeroTolerance)
      return new LineCurve(start, end);

    // Calculate the chord and its midpoint between the two points.
    Vector3d chord = end - start;
    Point3d mid = start + chord / 2;
    // Define the arc's radius as half the chord length.
    double radius = chord.Length / 2;
    // Offset the midpoint by the inward vector scaled by the radius to form the arc's peak.
    Point3d arcMid = mid + inward * radius;
    
    // Create the arc using the start, offset midpoint, and end.
    Arc arc = new Arc(start, arcMid, end);
    // Return the arc as a NurbsCurve if valid; otherwise, fall back to a straight line.
    return arc.IsValid ? arc.ToNurbsCurve() : new LineCurve(start, end);
  }

  /// <summary>
  /// Divides an edge between two points into a specified number of equal segments.
  /// Returns a list of points that includes both the start and end points.
  /// </summary>
  private List<Point3d> DivideEdge(Point3d start, Point3d end, int divisions)
  {
    List<Point3d> pts = new List<Point3d>();
    // Calculate the step vector for each division.
    Vector3d step = (end - start) / divisions;
    // Generate and add each point along the edge.
    for (int i = 0; i <= divisions; i++)
      pts.Add(start + step * i);
    return pts;
  }
}
# ---------- end teethxc ----------

teethlaser = CSharpScript(
    rect=move_2.Geometry,
    divisions=Slider(7, range=0..10),
    spacing=Slider(1.9, range=0..10),
    subLength=Slider(1.5, range=0..10))  # -> out, A; inputs rect: Rectangle3d, divisions: Int32, spacing: Double, subLength: Double
# ---------- teethlaser: C# ----------
#region // begin main code
using System;
using System.Collections.Generic;
using Rhino;
using Rhino.Geometry;
using Grasshopper.Kernel; // For GH_RuntimeMessageLevel

public class Script_Instance : GH_ScriptInstance
{
  /// <summary>
  /// Main entry point.
  /// </summary>
  /// <param name="rect">
  /// Input rectangle (Rhino.Geometry.Rectangle3d). Corners assumed in order: A, B, C, D.
  /// </param>
  /// <param name="divisions">
  /// Number of segments to divide edges A–B and C–D.
  /// </param>
  /// <param name="spacing">
  /// Spacing value to inset each division segment.
  /// </param>
  /// <param name="subLength">
  /// Length that each sub-rectangle (tooth) extends outward from the main rectangle.
  /// </param>
  /// <param name="A">
  /// Output: A polycurve representing the outer boundary (union) of the trimmed main rectangle with the sub-rectangles.
  /// </param>
  private void RunScript(
		Rectangle3d rect,
		int divisions,
		double spacing,
		double subLength,
		ref object A)
  {
    // Ensure divisions is at least 1.
    divisions = Math.Max(divisions, 1);
    
    // Get corners of the main rectangle.
    Point3d ptA = rect.Corner(0);
    Point3d ptB = rect.Corner(1);
    Point3d ptC = rect.Corner(2);
    Point3d ptD = rect.Corner(3);
    Point3d center = rect.Center;
    
    // --- Create sub-rectangles ("tooths") along edge A-B ---
    List<Rectangle3d> subRectangles_AB = new List<Rectangle3d>();
    List<Point3d> ptsAB = DivideEdge(ptA, ptB, divisions);
    
    // Outward direction for edge A-B: reverse vector from edge midpoint to center.
    Point3d midAB = new Point3d((ptA.X + ptB.X)/2.0, (ptA.Y + ptB.Y)/2.0, (ptA.Z + ptB.Z)/2.0);
    Vector3d insideDirAB = center - midAB;
    insideDirAB.Unitize();
    Vector3d outwardAB = -insideDirAB;
    
    for (int i = 0; i < divisions; i++)
    {
      Point3d p0 = ptsAB[i];
      Point3d p1 = ptsAB[i + 1];
      Vector3d baseDir = p1 - p0;
      double segLength = baseDir.Length;
      if(segLength <= RhinoMath.ZeroTolerance) continue;
      baseDir.Unitize();
      
      // Inset each end by spacing/2.
      Point3d newP0 = p0 + baseDir * (spacing / 2.0);
      Point3d newP1 = p1 - baseDir * (spacing / 2.0);
      double adjustedLength = newP0.DistanceTo(newP1);
      
      // Define a plane for the tooth: origin at newP0, x-axis along adjusted base, y-axis = outward.
      Plane planeAB = new Plane(newP0, baseDir, outwardAB);
      
      // Build the tooth as a Rectangle3d.
      Rectangle3d toothAB = new Rectangle3d(planeAB, new Interval(0, adjustedLength), new Interval(0, subLength));
      subRectangles_AB.Add(toothAB);
    }
    // Remove first and last tooth from the A-B set.
    if (subRectangles_AB.Count > 2)
    {
      subRectangles_AB.RemoveAt(0);
      subRectangles_AB.RemoveAt(subRectangles_AB.Count - 1);
    }
    else
      subRectangles_AB.Clear();
    
    // --- Create sub-rectangles ("tooths") along edge C-D ---
    List<Rectangle3d> subRectangles_CD = new List<Rectangle3d>();
    List<Point3d> ptsCD = DivideEdge(ptC, ptD, divisions);
    ptsCD.Reverse(); // Reverse so segments correspond.
    Point3d midCD = new Point3d((ptC.X + ptD.X)/2.0, (ptC.Y + ptD.Y)/2.0, (ptC.Z + ptD.Z)/2.0);
    Vector3d insideDirCD = center - midCD;
    insideDirCD.Unitize();
    Vector3d outwardCD = -insideDirCD;
    
    for (int i = 0; i < divisions; i++)
    {
      Point3d p0 = ptsCD[i];
      Point3d p1 = ptsCD[i + 1];
      Vector3d baseDir = p1 - p0;
      double segLength = baseDir.Length;
      if(segLength <= RhinoMath.ZeroTolerance) continue;
      baseDir.Unitize();
      
      Point3d newP0 = p0 + baseDir * (spacing / 2.0);
      Point3d newP1 = p1 - baseDir * (spacing / 2.0);
      double adjustedLength = newP0.DistanceTo(newP1);
      
      Plane planeCD = new Plane(newP0, baseDir, outwardCD);
      Rectangle3d toothCD = new Rectangle3d(planeCD, new Interval(0, adjustedLength), new Interval(0, subLength));
      subRectangles_CD.Add(toothCD);
    }
    if (subRectangles_CD.Count > 2)
    {
      subRectangles_CD.RemoveAt(0);
      subRectangles_CD.RemoveAt(subRectangles_CD.Count - 1);
    }
    else
      subRectangles_CD.Clear();
    
    // --- Convert main rectangle and sub-rectangles into closed curves ---
    // Create a closed polyline for the main rectangle.
    Polyline mainPolyline = new Polyline(new List<Point3d> { ptA, ptB, ptC, ptD, ptA });
    Curve mainCurve = mainPolyline.ToNurbsCurve();
    
    // Convert each tooth into a closed curve.
    List<Curve> toothCurves = new List<Curve>();
    foreach (Rectangle3d r in subRectangles_AB)
    {
      Curve c = r.ToNurbsCurve();
      toothCurves.Add(c);
    }
    foreach (Rectangle3d r in subRectangles_CD)
    {
      Curve c = r.ToNurbsCurve();
      toothCurves.Add(c);
    }
    
    // Prepare a list of curves for Boolean union.
    List<Curve> allCurves = new List<Curve>();
    allCurves.Add(mainCurve);
    allCurves.AddRange(toothCurves);
    
    double tol = Rhino.RhinoDoc.ActiveDoc != null ? Rhino.RhinoDoc.ActiveDoc.ModelAbsoluteTolerance : 0.001;
    Curve[] unionCurves = Curve.CreateBooleanUnion(allCurves, tol);
    
    if (unionCurves == null || unionCurves.Length == 0)
    {
      AddRuntimeMessage(GH_RuntimeMessageLevel.Warning, "Curve Boolean union failed.");
      A = null;
      return;
    }
    
    // If multiple curves were returned, join them.
    Curve joined = Curve.JoinCurves(unionCurves, tol).Length > 0 ?
                   Curve.JoinCurves(unionCurves, tol)[0] : unionCurves[0];
    
    // Output the resulting curve (should be the outer boundary).
    A = joined;
  }
  
  /// <summary>
  /// Helper function to divide a line segment into (divisions+1) equally spaced points.
  /// </summary>
  private List<Point3d> DivideEdge(Point3d start, Point3d end, int divisions)
  {
    List<Point3d> pts = new List<Point3d>();
    for (int i = 0; i <= divisions; i++)
    {
      double t = (double)i / divisions;
      pts.Add(Lerp(start, end, t));
    }
    return pts;
  }
  
  /// <summary>
  /// Custom linear interpolation for Point3d.
  /// </summary>
  private Point3d Lerp(Point3d a, Point3d b, double t)
  {
    double x = a.X + t * (b.X - a.X);
    double y = a.Y + t * (b.Y - a.Y);
    double z = a.Z + t * (b.Z - a.Z);
    return new Point3d(x, y, z);
  }
}
#endregion
# ---------- end teethlaser ----------

rotate_3d = Rotate3D(Geometry=orient.Geometry, Angle=1.570796327, Center=area_2.Centroid, Axis=deconstruct_plane.XAxis)  # -> Geometry, Transform

# ----
# TeethXC further development
number_slider = Slider(6.3, range=0..10)  # disabled
number_slider_2 = Slider(5.6, range=0..10)  # disabled
number_slider_3 = Slider(7.8, range=0..10)  # disabled
number_slider_4 = Slider(4, range=0..10)  # disabled
number_slider_5 = Slider(1, range=0..1)  # disabled
number_slider_6 = Slider(7.6, range=0..10)  # disabled
negative_2 = Negative(Value=number_slider_3)  # disabled
subtraction = Subtraction(A=number_slider_4, B=number_slider_5)  # disabled
teethxc_2 = CSharpScript(
    rect=rectangle_3.Rectangle,
    divisions=number_slider_4,
    spacing=number_slider,
    subLength=negative_2,
    negDivisions=subtraction,
    negSpacing=number_slider_2,
    negSubLength=negative_2,
    negOffset=number_slider_6)  # -> out, A, B, C; inputs rect: Rectangle3d, divisions: Int32, spacing: Double, subLength: Double, negDivisions: Int32, negSpacing: Double, negSubLength: Double, negOffset: Double; disabled
# ---------- teethxc_2: C# ----------
using System;
using System.Collections.Generic;
using Rhino;
using Rhino.Geometry;
public class Script_Instance : GH_ScriptInstance
{

private void RunScript(
		Rectangle3d rect,
		int divisions,
		double spacing,
		double subLength,
		int negDivisions,
		double negSpacing,
		double negSubLength,
		double negOffset,
		ref object A,
		ref object B,
		ref object C)
{
  // 1. Generate positive teethed boundary curve
  PolyCurve posBoundary = GenerateTeethedBoundary(rect, divisions, spacing, subLength);

  // 2. Generate negative, rotated, offset teethed boundary
  Plane negPlane = rect.Plane;
  Point3d center = rect.Center;
  negPlane.Rotate(Math.PI / 2, negPlane.ZAxis, center);

  // Offset the rectangle so negative is always inside positive (robust Boolean)
  double newWidth = Math.Max(0.01, rect.Width - negOffset);
  double newHeight = Math.Max(0.01, rect.Height - negOffset);
  Rectangle3d negRect = new Rectangle3d(negPlane, newWidth, newHeight);

  // Move negative rectangle to center
  negRect.Transform(Transform.Translation(rect.Center - negRect.Center));
  PolyCurve negBoundary = GenerateTeethedBoundary(negRect, negDivisions, negSpacing, negSubLength);
  negBoundary.Reverse(); // Flip for Boolean orientation

  // Output raw boundaries for visual debug
  B = posBoundary.DuplicateCurve();
  C = negBoundary.DuplicateCurve();

  // 3. Curve Boolean difference (curve must be closed, planar, no self-intersections)
Curve[] diff = Curve.CreateBooleanDifference(posBoundary, negBoundary, 0.001);

  // Output result (if Boolean fails, output the positive curve as fallback)
 if (diff != null && diff.Length > 0)
    A = diff;
else
    A = posBoundary.DuplicateCurve();


// Helper: Generate closed teethed boundary curve
PolyCurve GenerateTeethedBoundary(Rectangle3d rect, int divisions, double spacing, double subLength)
{
  Point3d ptA = rect.Corner(0);
  Point3d ptB = rect.Corner(1);
  Point3d ptC = rect.Corner(2);
  Point3d ptD = rect.Corner(3);
  Point3d rectCenter = rect.Center;

  Vector3d topInward = GetInwardVector(ptA, ptB, rectCenter);
  Vector3d botInward = GetInwardVector(ptC, ptD, rectCenter);

  List<Curve> teethTop = Create3EdgeTeeth(ptA, ptB, divisions, spacing, subLength, topInward);
  List<Curve> teethBot = Create3EdgeTeeth(ptC, ptD, divisions, spacing, subLength, botInward);

  PolyCurve compTop = BuildCompositeEdge(ptA, ptB, teethTop, topInward);
  PolyCurve compBot = BuildCompositeEdge(ptC, ptD, teethBot, botInward);

  PolyCurve finalBoundary = new PolyCurve();
  finalBoundary.Append(compTop);
  finalBoundary.Append(new LineCurve(ptB, ptC));
  finalBoundary.Append(compBot);
  finalBoundary.Append(new LineCurve(ptD, ptA));
  finalBoundary.MakeClosed(RhinoMath.ZeroTolerance);
  return finalBoundary;
}

// --- rest is unchanged ---
Vector3d GetInwardVector(Point3d start, Point3d end, Point3d center)
{
  Vector3d inward = center - (start + end) / 2.0;
  if (!inward.Unitize())
  {
    Vector3d edgeDir = end - start;
    if (edgeDir.Unitize())
      inward = Vector3d.CrossProduct(edgeDir, Vector3d.ZAxis);
    else
      inward = Vector3d.YAxis;
  }
  return inward;
}

List<Curve> Create3EdgeTeeth(Point3d start, Point3d end, int divisions, double spacing, double subLength, Vector3d inward)
{
  List<Curve> teeth = new List<Curve>();
  List<Point3d> pts = DivideEdge(start, end, divisions);
  for (int i = 0; i < divisions; i++)
  {
    Point3d segStart = pts[i];
    Point3d segEnd = pts[i + 1];
    Vector3d edgeDir = segEnd - segStart;
    if (!edgeDir.Unitize()) continue;
    Point3d baseStart = segStart + edgeDir * (spacing / 2);
    Point3d baseEnd = segEnd - edgeDir * (spacing / 2);
    Point3d tipStart = baseStart + inward * subLength;
    Point3d tipEnd = baseEnd + inward * subLength;
    teeth.Add(new LineCurve(baseStart, tipStart));
    teeth.Add(new LineCurve(tipStart, tipEnd));
    teeth.Add(new LineCurve(tipEnd, baseEnd));
  }
  return teeth;
}

PolyCurve BuildCompositeEdge(Point3d startPt, Point3d endPt, List<Curve> teeth, Vector3d inward)
{
  PolyCurve composite = new PolyCurve();
  if (teeth.Count == 0)
  {
    composite.Append(new LineCurve(startPt, endPt));
    return composite;
  }
  composite.Append(CreateArc(startPt, teeth[0].PointAtStart, inward));
  for (int i = 0; i < teeth.Count; i += 3)
  {
    composite.Append(teeth[i]);
    composite.Append(teeth[i + 1]);
    composite.Append(teeth[i + 2]);
    if (i < teeth.Count - 3)
    {
      composite.Append(CreateArc(
        teeth[i + 2].PointAtEnd,
        teeth[i + 3].PointAtStart,
        inward
      ));
    }
  }
  composite.Append(CreateArc(teeth[teeth.Count - 1].PointAtEnd, endPt, inward));
  return composite;
}

Curve CreateArc(Point3d start, Point3d end, Vector3d inward)
{
  if (start.DistanceTo(end) < RhinoMath.ZeroTolerance)
    return new LineCurve(start, end);
  Vector3d chord = end - start;
  Point3d mid = start + chord / 2;
  double radius = chord.Length / 2;
  Point3d arcMid = mid + inward * radius;
  Arc arc = new Arc(start, arcMid, end);
  return arc.IsValid ? arc.ToNurbsCurve() : new LineCurve(start, end);
}

List<Point3d> DivideEdge(Point3d start, Point3d end, int divisions)
{
  List<Point3d> pts = new List<Point3d>();
  Vector3d step = (end - start) / divisions;
  for (int i = 0; i <= divisions; i++)
    pts.Add(start + step * i);
  return pts;

}}}
# ---------- end teethxc_2 ----------
number_slider_7 = Slider(1.2, range=0..10)  # disabled
geometry = Geometry(teethxc_2.C)  # disabled
geometry_2 = Geometry(teethxc_2.B)  # disabled
bounding_box = BoundingBox(Content=geometry_2, Plane=PlaneXY(0, 0, 0))  # -> Box, Box_2; disabled
curve_to_polyline = CurveToPolyline(Curve=geometry_2, ToleranceDistance=number_slider_7, ToleranceAngle=0)  # -> Polyline, Segments; disabled
number_slider_8 = Slider(2, range=0..10)  # disabled
deconstruct_brep = DeconstructBrep(Brep=bounding_box.Box)  # -> Faces, Edges, Vertices; disabled
polygon_center = PolygonCenter(Polyline=curve_to_polyline.Polyline)  # -> CenterV, CenterE, CenterA; disabled
list_item = ListItem(List=deconstruct_brep.Vertices, Index=number_slider_8, Wrap=True)  # disabled
rotate_3d_2 = Rotate3D(Geometry=polygon_center.CenterA, Angle=1.570796327, Center=list_item, Axis=Vector(0, 0, 1))  # -> Geometry, Transform; disabled
orient_2 = Orient(Geometry=geometry_2, Source=polygon_center.CenterA, Target=rotate_3d_2.Geometry)  # -> Geometry, Transform; disabled
unit_z = UnitZ(Factor=1)  # disabled
rotate_3d_3 = Rotate3D(Geometry=orient_2.Geometry, Angle=1.570796327, Center=rotate_3d_2.Geometry, Axis=unit_z)  # -> Geometry, Transform; disabled
unit_x = UnitX(Factor=1)  # disabled
rotate_3d_4 = Rotate3D(Geometry=rotate_3d_3.Geometry, Angle=1.570796327, Center=rotate_3d_2.Geometry, Axis=unit_x)  # -> Geometry, Transform; disabled

number_slider_9 = Slider(1.3, range=0..10)  # disabled
number_slider_10 = Slider(3.1, range=0..10)  # disabled
number_slider_11 = Slider(1.2, range=0..10)  # disabled
number_slider_12 = Slider(8, range=0..10)  # disabled
number_slider_13 = Slider(1, range=0..1)  # disabled
number_slider_14 = Slider(0, range=0..10)  # disabled
number_slider_15 = Slider(10, range=0..10)  # disabled
negative_3 = Negative(Value=number_slider_10)  # disabled
subtraction_2 = Subtraction(A=number_slider_12, B=number_slider_13)  # disabled
panel = Panel("π/2")  # disabled
panel_2 = Panel("π/2")  # disabled
teethxc_3 = CSharpScript(
    rect=rectangle_3.Rectangle,
    divisions=number_slider_12,
    spacing=number_slider_11,
    subLength=negative_3,
    negDivisions=subtraction_2,
    negSpacing=number_slider_9,
    negSubLength=negative_3,
    negOffset=number_slider_14,
    angleZ=panel,
    angleX=panel_2,
    gap=number_slider_15)  # -> out, A, B, C; inputs rect: Rectangle3d, divisions: Int32, spacing: Double, subLength: Double, negDivisions: Int32, negSpacing: Double, negSubLength: Double, negOffset: Double, angleZ: Double, angleX: Double, gap: Double; disabled
# ---------- teethxc_3: C# ----------
using System;
using System.Collections.Generic;
using Rhino;
using Rhino.Geometry;

public class Script_Instance : GH_ScriptInstance
{
  private void RunScript(
		Rectangle3d rect,
		int divisions,
		double spacing,
		double subLength,
		int negDivisions,
		double negSpacing,
		double negSubLength,
		double negOffset,
		double angleZ,
		double angleX,
		double gap,
		ref object A,
		ref object B,
		ref object C)
  {
    // 1) Positive curve: NO transforms
    var posCurve = GenerateTeethedBoundary(rect, divisions, spacing, subLength);

    // 2) Negative: build, rotate, and translate as needed
    Plane negPlane = rect.Plane;
    Point3d center = rect.Center;
    negPlane.Rotate(Math.PI / 2, negPlane.ZAxis, center);
    double w = Math.Max(0.01, rect.Width - negOffset);
    double h = Math.Max(0.01, rect.Height - negOffset);
    var negRect = new Rectangle3d(negPlane, w, h);
    negRect.Transform(Transform.Translation(center - negRect.Center));
    var negCurve = GenerateTeethedBoundary(negRect, negDivisions, negSpacing, negSubLength);
    negCurve.Reverse();

    // ROTATE the negative curve only
    // (about its own center, or about world origin, as you wish)
    BoundingBox bbNeg = negCurve.GetBoundingBox(true);
    Point3d negCenter = bbNeg.Center;
    Transform rotZ = Transform.Rotation(angleZ, Vector3d.ZAxis, negCenter);
    Transform rotX = Transform.Rotation(angleX, Vector3d.XAxis, negCenter);
    negCurve.Transform(rotZ);
    negCurve.Transform(rotX);

    // SLIDE: move left edge of negative to right edge of positive + gap
    BoundingBox bbPos = posCurve.GetBoundingBox(true);
    bbNeg = negCurve.GetBoundingBox(true); // recalc after rotate
    double dx = (bbPos.Max.X + gap) - bbNeg.Min.X;
    Transform slideNeg = Transform.Translation(dx, 0.0, 0.0);
    negCurve.Transform(slideNeg);

    // 3) Output
    A = posCurve;
    B = negCurve;
    C = new Line(
      new Point3d(bbPos.Max.X, 0.0, 0.0),
      new Point3d(bbPos.Max.X + gap, 0.0, 0.0)
    ).ToNurbsCurve();
  }

  // === Helpers (unchanged) ===

  PolyCurve GenerateTeethedBoundary(Rectangle3d rect, int div, double spacing, double subLen)
  {
    Point3d A = rect.Corner(1), B = rect.Corner(2),
            C = rect.Corner(3), D = rect.Corner(0),
            ctr = rect.Center;
    var topIn = GetInward(A, B, ctr);
    var botIn = GetInward(C, D, ctr);
    var topTeeth = Create3EdgeTeeth(A, B, div, spacing, subLen, topIn);
    var botTeeth = Create3EdgeTeeth(C, D, div, spacing, subLen, botIn);
    var topEdge = BuildCompositeEdge(A, B, topTeeth, topIn);
    var botEdge = BuildCompositeEdge(C, D, botTeeth, botIn);
    var loop = new PolyCurve();
    loop.Append(topEdge);
    loop.Append(new LineCurve(B, C));
    loop.Append(botEdge);
    loop.Append(new LineCurve(C, A));
    loop.MakeClosed(RhinoMath.ZeroTolerance);
    return loop;
  }

  Vector3d GetInward(Point3d s, Point3d e, Point3d ctr)
  {
    var v = ctr - ((s + e) / 2.0);
    if (!v.Unitize())
    {
      var d = e - s;
      if (d.Unitize()) v = Vector3d.CrossProduct(d, Vector3d.ZAxis);
      else v = Vector3d.YAxis;
    }
    return v;
  }

  List<Curve> Create3EdgeTeeth(Point3d start, Point3d end, int div, double spacing, double subLen, Vector3d inward)
  {
    var teeth = new List<Curve>();
    var pts = DivideEdge(start, end, div);
    for (int i = 0; i < div; i++)
    {
      var s = pts[i];
      var e = pts[i + 1];
      var dir = e - s; dir.Unitize();
      var b1 = s + dir * (spacing / 2.0);
      var b2 = e - dir * (spacing / 2.0);
      var t1 = b1 + inward * subLen;
      var t2 = b2 + inward * subLen;
      teeth.Add(new LineCurve(b1, t1));
      teeth.Add(new LineCurve(t1, t2));
      teeth.Add(new LineCurve(t2, b2));
    }
    return teeth;
  }

  PolyCurve BuildCompositeEdge(Point3d s, Point3d e, List<Curve> teeth, Vector3d inward)
  {
    var pc = new PolyCurve();
    if (teeth.Count == 0)
    {
      pc.Append(new LineCurve(s, e));
      return pc;
    }
    pc.Append(CreateArc(s, teeth[0].PointAtStart, inward));
    for (int i = 0; i < teeth.Count; i += 3)
    {
      pc.Append(teeth[i]);
      pc.Append(teeth[i + 1]);
      pc.Append(teeth[i + 2]);
      if (i < teeth.Count - 3)
        pc.Append(CreateArc(
          teeth[i + 2].PointAtEnd,
          teeth[i + 3].PointAtStart,
          inward));
    }
    pc.Append(CreateArc(teeth[teeth.Count - 1].PointAtEnd, e, inward));
    return pc;
  }

  Curve CreateArc(Point3d a, Point3d b, Vector3d inward)
  {
    if (a.DistanceTo(b) < RhinoMath.ZeroTolerance)
      return new LineCurve(a, b);
    var chord = b - a;
    var mid = a + chord / 2.0;
    var r = chord.Length / 2.0;
    var apex = mid + inward * r;
    var arc = new Arc(a, apex, b);
    return arc.IsValid ? arc.ToNurbsCurve() : new LineCurve(a, b);
  }

  List<Point3d> DivideEdge(Point3d s, Point3d e, int div)
  {
    var pts = new List<Point3d>();
    var step = (e - s) / div;
    for (int i = 0; i <= div; i++)
      pts.Add(s + step * i);
    return pts;
  }
}
# ---------- end teethxc_3 ----------
geometry_3 = Geometry(teethxc_3.A)  # disabled
geometry_4 = Geometry(teethxc_3.B)  # disabled

number_slider_16 = Slider(1.5, range=0..10)
teethxl = CSharpScript(rect=rotate_3d.Geometry, divisions=Slider(7, range=0..10), spacing=Slider(0.8, range=0..10), subLength=number_slider_16)  # -> out, A; inputs rect: Rectangle3d, divisions: Int32, spacing: Double, subLength: Double; same code as teethlaser
panel_3 = Panel(teethxl.A)

explode = Explode(Curve=rotate_3d.Geometry, Recursive=True)  # -> Segments, Vertices

# ----
# two parts TeethXC
explode_2 = Explode(Curve=rectangle_3.Rectangle, Recursive=True)  # -> Segments, Vertices; disabled
number_slider_17 = Slider(4.5, range=0..10)  # disabled
number_slider_18 = Slider(4, range=0..10)  # disabled
number_slider_19 = Slider(4.5, range=0..10)  # disabled
number_slider_20 = Slider(4.7, range=0..10)  # disabled
number_slider_21 = Slider(3, range=0..10)  # disabled
list_item_2 = ListItem(List=explode_2.Segments, Index=0, Wrap=True)  # disabled
length = Length(Curve=list_item_2)  # disabled
addition = Addition(A=number_slider_18, B=number_slider_17)  # disabled
negative_4 = Negative(Value=number_slider_20)  # disabled
subtraction_3 = Subtraction(A=number_slider_18, B=number_slider_21)  # disabled
division = Division(A=length, B=number_slider_18)  # disabled
addition_2 = Addition(A=number_slider_19, B=division)  # disabled
teethxc_4 = CSharpScript(rect=move_3.Geometry, divisions=number_slider_18, spacing=number_slider_19, subLength=negative_4)  # -> out, A, B, C; inputs rect: Rectangle3d, divisions: Int32, spacing: Double, subLength: Double; disabled; same code as teethxc
teethxc_5 = CSharpScript(rect=move_3.Geometry, divisions=subtraction_3, spacing=addition_2, subLength=negative_4)  # -> out, A, B, C; inputs rect: Rectangle3d, divisions: Int32, spacing: Double, subLength: Double; disabled; same code as teethxc
geometry_5 = Geometry([teethxc_4.C, teethxc_4.A])  # disabled
panel_4 = Panel(teethxc_4.C)  # disabled
geometry_6 = Geometry([teethxc_5.C, teethxc_5.A])  # disabled
list_item_3 = ListItem(List=flatten(geometry_6), Index=0, Wrap=True)  # disabled
list_item_4 = ListItem(List=flatten(geometry_5), Index=0, Wrap=True)  # disabled
boundary_surfaces = BoundarySurfaces(Edges=list_item_3)  # disabled
boundary_surfaces_2 = BoundarySurfaces(Edges=list_item_4)  # disabled
move_4 = Move(Motion=Vector(0, 0, 10))  # -> Geometry, Transform; disabled

panel_5 = Panel(teethlaser.A)

domain_box = DomainBox(Base=PlaneXY(0, 0, 0), X=Domain(-2, 2), Y=Domain(-0.5, 0.5), Z=Domain(0, 0.25))
dispatch = Dispatch(List=explode.Segments, DispatchPattern=[True, False])  # -> ListA, ListB
dispatch_2 = Dispatch(List=dispatch.ListA, DispatchPattern=[True, False])  # -> ListA, ListB
boundary_surfaces_3 = BoundarySurfaces(Edges=teethxl.A)
loft = Loft(
    Curves=flatten(dispatch_2.ListB),
    Options={Adjust=False, Closed=False, LoftEnds=0, LoftSimp=0, LoftType=0, Rebuild=10, Refit=0.01})
loft_2 = Loft(
    Curves=flatten(dispatch_2.ListA),
    Options={Adjust=False, Closed=False, LoftEnds=0, LoftSimp=0, LoftType=0, Rebuild=10, Refit=0.01})
md_slider = MDSlider(SliderMode=0, slider_value=Point(0.5, 0.5, 0.5), x_domain=Domain(0, 1), y_domain=Domain(0, 1), z_domain=Domain(0, 1))
number_slider_22 = Slider(1.23, range=0..10)
number_slider_23 = Slider(0, range=0..100)
evaluate_surface = EvaluateSurface(Surface=reparameterize(boundary_surfaces_3), Point=md_slider)  # -> Point, Normal, UDirection, VDirection, Frame
addition_3 = Addition(A=number_slider_16, B=Slider(0.8, range=0..10))
cull_index = CullIndex(List=evaluate_surface.Normal, Indices=number_slider_23, Wrap=True)
cull_index_2 = CullIndex(List=boundary_surfaces_3, Indices=number_slider_23, Wrap=True)
list_item_5 = ListItem(List=boundary_surfaces_3, Index=number_slider_23, Wrap=True)
list_item_6 = ListItem(List=evaluate_surface.Normal, Index=number_slider_23, Wrap=True)
negative_5 = Negative(Value=addition_3)
amplitude = Amplitude(Vector=list_item_6, Amplitude=number_slider_22)
unit_z_2 = UnitZ(Factor=addition_3)
amplitude_2 = Amplitude(Vector=cull_index, Amplitude=number_slider_22)
unit_z_3 = UnitZ(Factor=negative_5)
reverse = Reverse(Vector=amplitude)
extrude = Extrude(Base=loft, Direction=unit_z_3)

extrude_2 = Extrude(Base=cull_index_2, Direction=amplitude_2)
extrude_3 = Extrude(Base=list_item_5, Direction=reverse)
extrude_4 = Extrude(Base=loft_2, Direction=unit_z_2)
solid_difference = SolidDifference(BrepsA=extrude, BrepsB=extrude_2)

merge = Merge(Data1=extrude_4, Data2=solid_difference, Data3=extrude_3, Data4=extrude_2)
unit_z_4 = UnitZ(Factor=Slider(120, range=0..1000))
unit_x_2 = UnitX(Factor=Slider(0, range=0..1000))
move_5 = Move(Geometry=solid_difference, Motion=unit_z_4)  # -> Geometry, Transform
move_6 = Move(Geometry=merge, Motion=unit_x_2)  # -> Geometry, Transform
surface = Surface(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)
brep_wireframe = BrepWireframe(Brep=surface, Density=-1)
unit_x_3 = UnitX(Factor=Slider(288, range=0..1000))
move_7 = Move(Geometry=brep_wireframe, Motion=unit_x_3)  # -> Geometry, Transform
xz_plane_4 = XZPlane(Origin=Point(0, 0, 0))
mirror = Mirror(Geometry=move_7.Geometry, Plane=xz_plane_4)  # -> Geometry, Transform
unit_y_4 = UnitY(Factor=Slider(106, range=0..1000))
move_8 = Move(Geometry=mirror.Geometry, Motion=unit_y_4)  # -> Geometry, Transform
genes = GenePool(Decimals=2, Maximum=1, Minimum=0, Value=[0.75, 0.15, 0.85, 0.6443475916, 0.34, 0.44, 0.54])

unixl = CSharpScript(
    inputCurves=move_8.Geometry,
    Values1=genes,
    Values2=genes,
    numSubdivisions=Slider(7, range=0..10),
    flipCurve2=Toggle(True),
    rectsPerLine=Slider(4, range=0..10),
    rectWidth=Slider(1.6, range=0..10),
    rectHeight=Slider(3.4, range=0..10),
    topLength=Slider(1.5, range=0..10),
    topWidthFactor=Slider(1.6, range=0..2),
    holeDiameter=Slider(0.6, range=0..2))  # -> out, segments, teeth, Circles, centres, instruction, nodes, LongSeg; inputs inputCurves: list of Curve, Values1: list of Double, Values2: list of Double, numSubdivisions: Int32, flipCurve2: Boolean, rectsPerLine: Int32, rectWidth: Double, rectHeight: Double, topLength: Double, topWidthFactor: Double, holeDiameter: Double
# ---------- unixl: C# ----------
using System;
using System.Collections.Generic;
using System.Linq;
using Rhino;
using Rhino.Geometry;
using Rhino.Geometry.Intersect;
using Grasshopper.Kernel;

public class Script_Instance : GH_ScriptInstance
{
  /// <summary>
  /// Main entry point.
  /// 
  /// Inputs:
  ///   inputCurves: at least two curves. The two longest become the primary edges.
  ///   Values1: (optional) normalized subdivision parameters (0–1) for the first edge.
  ///   Values2: (optional) normalized subdivision parameters for the second edge (must match count with Values1).
  ///   numSubdivisions: if no custom values are provided, evenly subdivide using this count.
  ///   flipCurve2: if true, the second edge is reversed before subdivision.
  ///   rectsPerLine, rectWidth, rectHeight, topLength, topWidthFactor, holeDiameter:
  ///       parameters for generating the node (trapezoidal tooth) geometry.
  /// 
  /// Outputs:
  ///   segments: the trimmed connector lines.
  ///   teeth: the laser node (tooth) polylines.
  ///   Circles: the connection holes as curves.
  ///   centres: the centres of the laser nodes.
  ///   instruction: the fitness value (penalty); lower is better.
  ///   nodes: the union of segments and teeth.
  ///   LongSeg: the trimmed portions of the two primary edges (longest curves) obtained by splitting them at intersections with nodes.
  /// 
  /// (The original evaluation criteria remain unchanged.)
  /// </summary>
  private void RunScript(
		List<Curve> inputCurves,
		List<double> Values1,
		List<double> Values2,
		int numSubdivisions,
		bool flipCurve2,
		int rectsPerLine,
		double rectWidth,
		double rectHeight,
		double topLength,
		double topWidthFactor,
		double holeDiameter,
		ref object segments,
		ref object teeth,
		ref object Circles,
		ref object centres,
		ref object instruction,
		ref object nodes,
		ref object LongSeg)
  {
    // 1. Validate inputs.
    if (inputCurves == null || inputCurves.Count < 2)
    {
      AddRuntimeMessage(GH_RuntimeMessageLevel.Error, "At least two curves are required.");
      return;
    }
    
    // 2. Determine primary edges and forbidden curves.
    var sortedCurves = inputCurves.OrderByDescending(c => c.GetLength()).ToList();
    Curve edge1 = sortedCurves[0];
    Curve edge2 = sortedCurves[1];
    // All remaining curves become forbidden.
    List<Curve> forbiddenCurves = sortedCurves.Skip(2).ToList();
    
    // If requested, flip the second edge.
    if (flipCurve2)
      edge2.Reverse();
    
    // 3. Compute subdivision points for each edge.
    List<Point3d> pts1, pts2;
    bool useCustom = (Values1 != null && Values2 != null &&
                      Values1.Count > 0 && Values1.Count == Values2.Count);
    
    if (useCustom)
    {
      Interval dom1 = edge1.Domain;
      Interval dom2 = edge2.Domain;
      pts1 = Values1.Select(p => edge1.PointAt(dom1.ParameterAt(p))).ToList();
      pts2 = Values2.Select(p => edge2.PointAt(dom2.ParameterAt(p))).ToList();
    }
    else
    {
      pts1 = GetSubdivisionPoints(edge1, numSubdivisions);
      pts2 = GetSubdivisionPoints(edge2, numSubdivisions);
    }
    
    // Create connectors by pairing corresponding points.
    List<Line> connectors = CreateConnectors(pts1, pts2);
    // For even subdivisions, trim the first and last connectors.
    if (!useCustom)
      TrimEdgeConnectors(ref connectors);
    
    // 4. Process connectors to generate node (tooth) geometry.
    List<Polyline> laserNodes = new List<Polyline>();
    List<Circle> connectionHoles = new List<Circle>();
    List<Point3d> nodeCenters = new List<Point3d>();
    List<Line> trimmedConnectors = new List<Line>();
    
    try
    {
      foreach (Line connector in connectors)
      {
        ProcessConnector(
          connector,
          rectsPerLine,
          rectWidth,
          rectHeight,
          topLength,
          topWidthFactor,
          holeDiameter,
          ref laserNodes,
          ref connectionHoles,
          ref nodeCenters,
          ref trimmedConnectors);
      }
    }
    catch (Exception ex)
    {
      AddRuntimeMessage(GH_RuntimeMessageLevel.Error, ex.Message);
      return;
    }
    
    // 5. Set standard outputs.
    segments = trimmedConnectors;
    teeth = laserNodes;
    Circles = connectionHoles.Select(c => c.ToNurbsCurve()).ToList<Curve>();
    centres = nodeCenters;
    
    double fitness = EvaluateFitness(connectors, laserNodes, forbiddenCurves, edge1, edge2, pts1, pts2);
    instruction = fitness;
    
    // --- New Step 1: Join teeth with segments to form nodes.
    List<Curve> nodesList = new List<Curve>();
    // Convert trimmed connector lines (segments) to curves.
    foreach(Line seg in trimmedConnectors)
      nodesList.Add(seg.ToNurbsCurve());
    // Convert each laser node (polyline) to a NurbsCurve.
    foreach(Polyline poly in laserNodes)
      nodesList.Add(poly.ToNurbsCurve());
    nodes = nodesList;
    
    // --- New Step 2: Trim the primary edges (edge1 and edge2) using intersections with the nodes.
    List<Curve> longSegList = new List<Curve>();
    // Use the union of nodesList as the trimming geometry.
    foreach (Curve primEdge in new Curve[] { edge1, edge2 })
    {
      // Accumulate intersection parameters.
      List<double> tParams = new List<double>();
      foreach (Curve nodeCurve in nodesList)
      {
        CurveIntersections inters = Intersection.CurveCurve(primEdge, nodeCurve, Rhino.RhinoDoc.ActiveDoc.ModelAbsoluteTolerance, Rhino.RhinoDoc.ActiveDoc.ModelAbsoluteTolerance);
        if (inters != null && inters.Count > 0)
        {
          foreach (IntersectionEvent ie in inters)
          {
            tParams.Add(ie.ParameterA);
          }
        }
      }
      tParams.Sort();
      // If we have at least one intersection, split the curve.
      if (tParams.Count > 0)
      {
        Curve[] splits = primEdge.Split(tParams.ToArray());
        if (splits != null)
        {
          // Optionally, you could choose the longest split segment or join segments.
          // Here we simply add all split segments.
          longSegList.AddRange(splits);
        }
        else
        {
          longSegList.Add(primEdge.DuplicateCurve());
        }
      }
      else
      {
        // If no intersections, output the full curve.
        longSegList.Add(primEdge.DuplicateCurve());
      }
    }
    LongSeg = longSegList;
  }
  
  // --- HELPER METHODS ---
  
  // Evenly subdivides a curve into a given count.
  private List<Point3d> GetSubdivisionPoints(Curve crv, int count)
  {
    double[] tParams = crv.DivideByCount(count, true);
    return tParams.Select(t => crv.PointAt(t)).ToList();
  }
  
  // Creates connectors by pairing corresponding points.
  private List<Line> CreateConnectors(List<Point3d> pts1, List<Point3d> pts2)
  {
    int minCount = Math.Min(pts1.Count, pts2.Count);
    return Enumerable.Range(0, minCount)
                     .Select(i => new Line(pts1[i], pts2[i]))
                     .ToList();
  }
  
  // Trims the first and last connectors (used when subdivisions are generated evenly).
  private void TrimEdgeConnectors(ref List<Line> connectors)
  {
    if (connectors.Count > 2)
    {
      connectors.RemoveAt(0);
      connectors.RemoveAt(connectors.Count - 1);
    }
  }
  
  // Processes a connector by dividing it into nodes and generating the node (tooth) geometry.
  private void ProcessConnector(
    Line connector,
    int nodesPerLine,
    double baseWidth,
    double baseHeight,
    double topExtension,
    double topWidthRatio,
    double holeSize,
    ref List<Polyline> nodes,
    ref List<Circle> holes,
    ref List<Point3d> centers,
    ref List<Line> trimmedLines)
  {
    Curve crv = connector.ToNurbsCurve();
    double[] tParams = crv.DivideByCount(nodesPerLine, true);
    
    Vector3d lineDir = connector.Direction;
    lineDir.Unitize();
    
    // Compute a normal for offset.
    Vector3d normal = ComputeFabricationNormal(lineDir);
    List<Interval> occupiedSections = new List<Interval>();
    
    for (int i = 1; i < tParams.Length - 1; i++)
    {
      CreateFabricationNode(
        crv,
        tParams[i],
        baseWidth,
        baseHeight,
        topExtension,
        topWidthRatio,
        holeSize,
        lineDir,
        normal,
        i,
        ref nodes,
        ref holes,
        ref centers,
        ref occupiedSections);
    }
    
    trimmedLines.AddRange(CalculateValidConnectors(crv, occupiedSections));
  }
  
  // Computes a normal vector based on a given direction.
  private Vector3d ComputeFabricationNormal(Vector3d direction)
  {
    Vector3d normal = Vector3d.CrossProduct(direction, Vector3d.ZAxis);
    if (!normal.Unitize())
    {
      normal = Vector3d.CrossProduct(direction, Vector3d.XAxis);
      normal.Unitize();
    }
    return normal;
  }
  
  // Creates a single laser node (tooth) at the given parameter along the connector.
  private void CreateFabricationNode(
    Curve connector,
    double tParam,
    double baseWidth,
    double baseHeight,
    double topExtension,
    double topWidthRatio,
    double holeSize,
    Vector3d lineDir,
    Vector3d normal,
    int index,
    ref List<Polyline> nodes,
    ref List<Circle> holes,
    ref List<Point3d> centers,
    ref List<Interval> occupiedSections)
  {
    Point3d basePoint = connector.PointAt(tParam);
    double offsetSign = (index % 2 == 0) ? 1 : -1;
    Vector3d heightOffset = normal * (baseHeight / 2 * offsetSign);
    
    Point3d center = basePoint + heightOffset;
    centers.Add(center);
    
    Plane nodePlane = new Plane(center, lineDir, offsetSign * normal);
    Polyline node = CreateLaserNode(nodePlane, baseWidth, baseHeight, topExtension, topWidthRatio);
    nodes.Add(node);
    
    Circle hole = new Circle(nodePlane, holeSize / 2);
    holes.Add(hole);
    
    double paramRange = connector.Domain.Max - connector.Domain.Min;
    double paramPerWidth = (baseWidth / 2) / connector.GetLength() * paramRange;
    occupiedSections.Add(new Interval(tParam - paramPerWidth, tParam + paramPerWidth));
  }
  
  // Constructs a polyline representing the laser node (tooth) geometry.
  private Polyline CreateLaserNode(Plane plane, double baseWidth, double baseHeight, double topExtension, double widthRatio)
  {
    widthRatio = Rhino.RhinoMath.Clamp(widthRatio, 0.1, 2.0);
    double halfBase = baseWidth / 2;
    double halfTop = halfBase * widthRatio;
    double baseY = -baseHeight / 2;
    
    return new Polyline(new[] {
      plane.PointAt(halfBase, baseY),
      plane.PointAt(halfTop, topExtension),
      plane.PointAt(-halfTop, topExtension),
      plane.PointAt(-halfBase, baseY)
    });
  }
  
  // Returns connector segments that are unoccupied.
  private List<Line> CalculateValidConnectors(Curve connector, List<Interval> occupied)
  {
    List<Interval> merged = MergeIntervals(occupied);
    List<Interval> freeSections = CalculateFreeSections(merged, connector.GetLength());
    return freeSections.Select(interval => 
      new Line(connector.PointAt(interval.Min), connector.PointAt(interval.Max))
    ).ToList();
  }
  
  // Merges overlapping intervals.
  private List<Interval> MergeIntervals(List<Interval> intervals)
  {
    if (!intervals.Any()) return intervals;
    intervals.Sort((a, b) => a.Min.CompareTo(b.Min));
    List<Interval> merged = new List<Interval> { intervals[0] };
    for (int i = 1; i < intervals.Count; i++)
    {
      Interval last = merged.Last();
      if (intervals[i].Min <= last.Max)
        merged[merged.Count - 1] = new Interval(last.Min, Math.Max(last.Max, intervals[i].Max));
      else
        merged.Add(intervals[i]);
    }
    return merged;
  }
  
  // Computes free intervals along a curve.
  private List<Interval> CalculateFreeSections(List<Interval> occupied, double totalLength)
  {
    List<Interval> free = new List<Interval>();
    double currentStart = 0;
    foreach (Interval interval in occupied.OrderBy(i => i.Min))
    {
      if (interval.Min > currentStart)
        free.Add(new Interval(currentStart, interval.Min));
      currentStart = interval.Max;
    }
    if (currentStart < totalLength)
      free.Add(new Interval(currentStart, totalLength));
    return free;
  }
  
  /// <summary>
  /// Evaluates fitness using three criteria:
  ///   (a) Angle penalty – For each connector, the angle between its direction and the tangent
  ///       of each primary edge (at the corresponding subdivision point) must be between 88° and 93°.
  ///       Deviations add a penalty scaled by angleFactor.
  ///   (b) Intersection penalty – Each intersection between any connector or any laser node (tooth)
  ///       and any forbidden curve adds a penalty scaled by intersectionFactor.
  ///   (c) Proximity & Perpendicularity penalty – For each connector and each forbidden curve,
  ///       the connector is sampled (10 points). If the minimum distance from these samples to the forbidden curve is less than minDist,
  ///       a penalty proportional to (minDist - distance) is added (scaled by distanceFactor). Also, at the closest sample,
  ///       the angle between the connector’s direction and the forbidden curve’s tangent should be 90°.
  ///       Any deviation beyond perpTol adds a penalty scaled by perpFactor.
  /// </summary>
  private double EvaluateFitness(
    List<Line> connectors,
    List<Polyline> nodes,
    List<Curve> forbiddenCurves,
    Curve edge1,
    Curve edge2,
    List<Point3d> pts1,
    List<Point3d> pts2)
  {
    double penalty = 0.0;
    double tol = Rhino.RhinoDoc.ActiveDoc != null ? Rhino.RhinoDoc.ActiveDoc.ModelAbsoluteTolerance : 0.001;
    
    // Scaling factors.
    double angleFactor = 0.1;
    double intersectionFactor = 0.1;
    double distanceFactor = 0.2; // For proximity penalty.
    double perpFactor = 0.2;     // For perpendicularity penalty.
    
    // Distance threshold and perpendicular tolerance.
    double minDist = 5.0;   // Minimum allowed distance from connector to forbidden curves.
    double perpTol = 5.0;   // Allowed deviation (in degrees) from perfect perpendicular (90°).
    
    // (a) Angle penalty for primary edges.
    for (int i = 0; i < connectors.Count; i++)
    {
      Line conn = connectors[i];
      
      double t1;
      edge1.ClosestPoint(pts1[i], out t1);
      Vector3d tan1 = edge1.TangentAt(t1);
      tan1.Unitize();
      
      double t2;
      edge2.ClosestPoint(pts2[i], out t2);
      Vector3d tan2 = edge2.TangentAt(t2);
      tan2.Unitize();
      
      Vector3d connDir = conn.Direction;
      connDir.Unitize();
      
      double angle1 = Rhino.RhinoMath.ToDegrees(Vector3d.VectorAngle(tan1, connDir));
      double angle2 = Rhino.RhinoMath.ToDegrees(Vector3d.VectorAngle(tan2, connDir));
      
      // Acceptable range: 88° to 93°.
      if (angle1 < 88)
        penalty += (88 - angle1) * angleFactor;
      else if (angle1 > 93)
        penalty += (angle1 - 93) * angleFactor;
      
      if (angle2 < 88)
        penalty += (88 - angle2) * angleFactor;
      else if (angle2 > 93)
        penalty += (angle2 - 93) * angleFactor;
    }
    
    // (b) Intersection penalty for connectors.
    foreach (Line conn in connectors)
    {
      Curve connCurve = conn.ToNurbsCurve();
      foreach (Curve f in forbiddenCurves)
      {
        CurveIntersections inters = Intersection.CurveCurve(connCurve, f, tol, tol);
        if (inters != null && inters.Count > 0)
          penalty += inters.Count * intersectionFactor;
      }
    }
    
    // (c) Intersection penalty for laser node (tooth) polylines.
    foreach (Polyline node in nodes)
    {
      Curve nodeCurve = node.ToNurbsCurve();
      foreach (Curve f in forbiddenCurves)
      {
        CurveIntersections inters = Intersection.CurveCurve(nodeCurve, f, tol, tol);
        if (inters != null && inters.Count > 0)
          penalty += inters.Count * intersectionFactor;
      }
    }
    
    // (d) Proximity & Perpendicularity penalty for each connector relative to each forbidden curve.
    // For each connector, sample 10 points uniformly.
    int numSamples = 10;
    foreach (Line conn in connectors)
    {
      Curve connCurve = conn.ToNurbsCurve();
      double connDomainLength = connCurve.Domain.Length;
      // For each forbidden curve:
      foreach (Curve f in forbiddenCurves)
      {
        double minSampleDist = double.MaxValue;
        double bestSampleParam = connCurve.Domain.Min;
        // Sample along the connector.
        for (int j = 0; j < numSamples; j++)
        {
          double t = connCurve.Domain.Min + (connDomainLength * j) / (numSamples - 1);
          Point3d samplePt = connCurve.PointAt(t);
          double tF;
          f.ClosestPoint(samplePt, out tF);
          Point3d closestPt = f.PointAt(tF);
          double d = samplePt.DistanceTo(closestPt);
          if (d < minSampleDist)
          {
            minSampleDist = d;
            bestSampleParam = t;
          }
        }
        // If the minimum distance is less than the threshold, add a penalty.
        if (minSampleDist < minDist)
          penalty += (minDist - minSampleDist) * distanceFactor;
        
        // At the sample point that gave minSampleDist, check perpendicularity.
        Point3d bestPt = connCurve.PointAt(bestSampleParam);
        double tF_best;
        f.ClosestPoint(bestPt, out tF_best);
        Vector3d fTan = f.TangentAt(tF_best);
        fTan.Unitize();
        Vector3d connDir = conn.Direction;
        connDir.Unitize();
        double angle = Rhino.RhinoMath.ToDegrees(Vector3d.VectorAngle(fTan, connDir));
        double deviation = Math.Abs(angle - 90);
        if (deviation > perpTol)
          penalty += (deviation - perpTol) * perpFactor;
      }
    }
    
    return penalty;
  }
}
# ---------- end unixl ----------
point = Point(unixl.centres)
curve = Curve(unixl.teeth)
curve_2 = Curve(unixl.Circles)
curve_3 = Curve(unixl.segments)
curve_4 = Curve(unixl.nodes)
curve_5 = Curve(unixl.LongSeg)

merge_2 = Merge(Data1=curve_3, Data2=curve)
panel_6 = Panel(curve_4)  # disabled
join = JoinCurves(Curves=flatten(merge_2), Preserve=False)

gene_pool = GenePool(Decimals=2, Maximum=1, Minimum=0, Value=[0.14, 0.25, 0.34, 0.45, 0.63, 0.74, 0.85, 0.54])
# To be corrected Negative node: nodepart1 segment exceeds limit when reverse node false.
# 
# 
# to be solved: Circles and centre dont appear
boolean_toggle = BooleanToggle(False)
unixc_v55 = CSharpScript(
    inputCurves=move_8.Geometry,
    Values1=gene_pool,
    Values2=gene_pool,
    numSubdivisions=Slider(6, range=0..10),
    flipCurve2=Toggle(True),
    rectsPerLine=Slider(4, range=0..10),
    rectWidth=Slider(1.2, range=0..10),
    rectHeight=Slider(2.1, range=0..10),
    topLength=Slider(1.8, range=0..10),
    topWidthFactor=Slider(1.7, range=0..2),
    holeDiameter=Slider(1, range=0..2),
    arcRadius=Slider(0.7, range=0..10),
    reverseNodes=boolean_toggle)  # -> out, segments, teeth, Circles, centres, instruction, nodepart1, nodepart2, LongSeg; inputs inputCurves: list of Curve, Values1: list of Double, Values2: list of Double, numSubdivisions: Int32, flipCurve2: Boolean, rectsPerLine: Int32, rectWidth: Double, rectHeight: Double, topLength: Double, topWidthFactor: Double, holeDiameter: Double, arcRadius: Double, arcTolerance: Double, reverseNodes: Boolean
# ---------- unixc_v55: C# ----------
using System;
using System.Collections.Generic;
using System.Linq;
using Rhino;
using Rhino.Geometry;
using Rhino.Geometry.Intersect;
using Grasshopper.Kernel;
using Grasshopper.Kernel.Types;

public class Script_Instance : GH_ScriptInstance
{
  // Tolerance for geometric operations
  private double _tolerance;
  private const double _angleTolerance = RhinoMath.DefaultAngleTolerance;

  // Data container for each fabrication node
  private class FabricationNodeData
  {
    public Polyline ToothPolyline { get; set; }
    public List<Line> ConnectingSegments { get; set; } = new List<Line>();
    public bool IsPositive { get; set; }
    public Point3d Center { get; set; }
    public Circle Hole { get; set; }
    public Point3d BaseLeftPt { get; set; }
    public Point3d BaseRightPt { get; set; }
    public Point3d TopLeftPt { get; set; }
    public Point3d TopRightPt { get; set; }
    public Curve OriginalConnector { get; set; }
    public double ConnectorParam { get; set; }
  }

  // Comparer for deduplicating split parameters
  private class ToleranceComparer : IEqualityComparer<double>
  {
    private readonly double _tol;
    public ToleranceComparer(double tol) { _tol = Math.Abs(tol); }
    public bool Equals(double x, double y) => Math.Abs(x - y) < _tol;
    public int GetHashCode(double obj) => obj.GetHashCode();
  }

  private void RunScript(
		List<Curve> inputCurves,
		List<double> Values1,
		List<double> Values2,
		int numSubdivisions,
		bool flipCurve2,
		int rectsPerLine,
		double rectWidth,
		double rectHeight,
		double topLength,
		double topWidthFactor,
		double holeDiameter,
		double arcRadius,
		double arcTolerance,
		bool reverseNodes,
		ref object segments,
		ref object teeth,
		ref object Circles,
		ref object centres,
		ref object instruction,
		ref object nodepart1,
		ref object nodepart2,
		ref object LongSeg)
  {
    bool revNodes = reverseNodes;
    _tolerance = RhinoDoc.ActiveDoc?.ModelAbsoluteTolerance ?? 0.001;

    // --- Input validation ---
    if (inputCurves == null || inputCurves.Count < 2)
    {
      AddRuntimeMessage(GH_RuntimeMessageLevel.Error, "Need at least two curves.");
      return;
    }
    inputCurves = inputCurves.Where(c => c != null && c.IsValid).ToList();
    if (inputCurves.Count < 2)
    {
      AddRuntimeMessage(GH_RuntimeMessageLevel.Error, "Not enough valid curves after filtering.");
      return;
    }
    if (rectsPerLine < 1) rectsPerLine = 1;

    // --- Primary edges ---
    List<Curve> sorted = inputCurves
      .OrderByDescending(c => c.GetLength())
      .Select(c => c.DuplicateCurve())
      .ToList();
    Curve edge1 = sorted[0];
    Curve edge2 = sorted[1];
    List<Curve> forbiddenCurves = sorted.Skip(2).ToList();
    if (flipCurve2 && !edge2.Reverse())
      AddRuntimeMessage(GH_RuntimeMessageLevel.Warning, "Failed to reverse second edge.");

    // --- Subdivision points ---
    List<Point3d> pts1, pts2;
    bool custom = Values1 != null && Values2 != null
                  && Values1.Count == Values2.Count && Values1.Count > 0;
    if (custom)
    {
      if (Values1.Any(v => v < 0 || v > 1) || Values2.Any(v => v < 0 || v > 1))
      {
        AddRuntimeMessage(GH_RuntimeMessageLevel.Error, "Custom subdivision parameters must be in [0,1].");
        return;
      }
      Interval d1 = edge1.Domain, d2 = edge2.Domain;
      pts1 = Values1.Select(t => edge1.PointAt(d1.ParameterAt(t))).ToList();
      pts2 = Values2.Select(t => edge2.PointAt(d2.ParameterAt(t))).ToList();
    }
    else
    {
      pts1 = GetSubdivisionPoints(edge1, numSubdivisions);
      pts2 = GetSubdivisionPoints(edge2, numSubdivisions);
      if (pts1 == null || pts2 == null) return;
    }

    // --- Connectors ---
    List<Line> connectors = CreateConnectors(pts1, pts2);
    if (connectors == null) return;
    if (!custom && connectors.Count > 2)
      TrimEdgeConnectors(ref connectors);

    // --- Process connectors → nodes + raw segments ---
    List<FabricationNodeData> allNodeData = new List<FabricationNodeData>();
    List<Line> allRawSegments = new List<Line>();
    foreach (var ln in connectors)
    {
      var crv = ln.ToNurbsCurve();
      if (crv == null || !crv.IsValid) continue;
      ProcessConnector(crv, rectsPerLine, rectWidth, rectHeight, topLength, topWidthFactor, holeDiameter,
                       ref allNodeData, ref allRawSegments);
    }

    // --- Clean raw segments ---
    List<Curve> tempNodeCurves = allNodeData
      .Select(nd => CombineToothAndSegments(nd, _tolerance))
      .Where(c => c != null && c.IsValid)
      .ToList();
    segments = CleanRawSegments(
      allRawSegments,
      tempNodeCurves,
      (arcRadius > _tolerance) ? arcRadius * arcTolerance : _tolerance * 2);

    // --- Fitness score ---
    instruction = EvaluateFitness(
      connectors,
      allNodeData.Select(nd => nd.ToothPolyline).ToList(),
      forbiddenCurves,
      edge1, edge2,
      pts1, pts2);

    // --- Final node parts: trim + arc for positives only ---
    List<Curve> positive = new List<Curve>();
    List<Curve> negative = new List<Curve>();
    List<Curve> forEdgeTrim = new List<Curve>();

    foreach (var nd in allNodeData)
    {
      Curve combined = CombineToothAndSegments(nd, _tolerance);
      if (combined == null || !combined.IsValid) continue;
      forEdgeTrim.Add(combined.DuplicateCurve());

      if (arcRadius > _tolerance)
      {
        bool filletInner = (nd.IsPositive == revNodes);
        var fil = FilletCombinedNodeManual_PointBased(combined, nd, arcRadius, _tolerance, filletInner);
        if (fil != null && fil.IsValid)
          combined = fil;
      }

      // --- Trim to base ---
      combined = TrimNodeCurve(combined, nd.BaseLeftPt, nd.BaseRightPt, _tolerance);

      // --- Arc extension for positive only ---
      if (nd.IsPositive && !revNodes)
      {
        var ext = BuildFullSequenceForNode(nd, combined, arcRadius, _tolerance, arcTolerance);
        if (ext != null && ext.IsValid)
          combined = ext;
      }

      if (nd.IsPositive) positive.Add(combined);
      else               negative.Add(combined);
    }

    nodepart1 = positive;
    nodepart2 = negative;

    // --- Trim primary edges by nodes ---
    LongSeg = TrimPrimaryEdges(
      new List<Curve> { edge1, edge2 },
      forEdgeTrim,
      _tolerance);
  }

  // --- Helper methods ---

  private List<Point3d> GetSubdivisionPoints(Curve crv, int count)
  {
    if (crv == null || !crv.IsValid) return null;
    count = Math.Max(1, count);
    double[] t = crv.DivideByCount(count, true);
    if (t == null || t.Length == 0)
      return new List<Point3d> { crv.PointAtStart, crv.PointAtEnd };
    return t.Select(p => crv.PointAt(p)).ToList();
  }

  private List<Line> CreateConnectors(List<Point3d> a, List<Point3d> b)
  {
    if (a == null || b == null) return null;
    int n = Math.Min(a.Count, b.Count);
    var list = new List<Line>();
    for (int i = 0; i < n; i++)
      if (a[i] != b[i])
        list.Add(new Line(a[i], b[i]));
    return list;
  }

  private void TrimEdgeConnectors(ref List<Line> c)
  {
    if (c != null && c.Count > 2)
    {
      c.RemoveAt(c.Count - 1);
      c.RemoveAt(0);
    }
  }

  private void ProcessConnector(
    Curve crv,
    int divisions,
    double baseW, double baseH,
    double topExt, double topW,
    double holeD,
    ref List<FabricationNodeData> nodes,
    ref List<Line> rawSegs)
  {
    if (crv == null || !crv.IsValid || crv.GetLength() < _tolerance) return;
    divisions = Math.Max(1, divisions);
    double[] t = crv.DivideByCount(divisions, true);
    if (t == null || t.Length < 2) return;

    Vector3d dir = crv.TangentAtStart;
    if (!dir.Unitize()) dir = crv.PointAtEnd - crv.PointAtStart;
    dir.Unitize();
    Vector3d norm = ComputeFabricationNormal(dir);
    if (norm.IsTiny()) return;

    var occupied = new List<Interval>();
    var onThis = new List<FabricationNodeData>();

    for (int i = 1; i < t.Length - 1; i++)
    {
      bool pos = ((i - 1) % 2 == 0);
      var nd = CreateFabricationNode(
        crv, t[i], baseW, baseH, topExt, topW, holeD,
        dir, norm, pos, ref occupied);
      if (nd != null) onThis.Add(nd);
    }

    if (!onThis.Any()) return;

    var free = CalculateFreeParameterIntervals(occupied, crv.Domain);
    foreach (var iv in free)
    {
      Point3d p0 = crv.PointAt(iv.Min), p1 = crv.PointAt(iv.Max);
      if (p0 != p1) rawSegs.Add(new Line(p0, p1));
    }

    AssociateSegmentsWithNodes(rawSegs, onThis);
    nodes.AddRange(onThis);
  }

  private Vector3d ComputeFabricationNormal(Vector3d dir)
  {
    if (dir.IsTiny(_tolerance)) return Vector3d.Zero;
    Vector3d n = Vector3d.CrossProduct(dir, Vector3d.ZAxis);
    if (n.Unitize()) return n;
    n = Vector3d.CrossProduct(dir, Vector3d.XAxis);
    if (n.Unitize()) return n;
    n = Vector3d.CrossProduct(dir, Vector3d.YAxis);
    n.Unitize();
    return n;
  }

  private FabricationNodeData CreateFabricationNode(
    Curve crv, double t,
    double bw, double bh,
    double te, double tw,
    double hd,
    Vector3d dir, Vector3d norm,
    bool pos,
    ref List<Interval> occupied)
  {
    Point3d basePt = crv.PointAt(t);
    double sign = pos ? 1.0 : -1.0;
    Vector3d off = norm * (bh / 2.0 * sign);
    Point3d center = basePt + off;
    Plane pl = new Plane(center, dir, norm * sign);
    if (!pl.IsValid) return null;

    Point3d bl, br, tl, tr;
    var poly = CreateLaserNodePolyline(pl, bw, bh, te, tw, out bl, out br, out tl, out tr);
    if (poly == null) return null;

    var hole = new Circle(pl, hd / 2.0);

    // mark occupied interval
    double paramPerLen = 1.0;
    var ders = crv.DerivativeAt(t, 1);
    if (ders != null && ders.Length > 1 && ders[1].Length > _tolerance)
      paramPerLen = 1.0 / ders[1].Length;
    else
    {
      double len = crv.GetLength(), dom = crv.Domain.Length;
      if (len > _tolerance && Math.Abs(dom) > _tolerance) paramPerLen = dom / len;
      else if (len > _tolerance) paramPerLen = 1.0 / len;
    }
    double halfW = (bw / 2.0) * paramPerLen;
    occupied.Add(new Interval(t - halfW, t + halfW));

    return new FabricationNodeData
    {
      ToothPolyline    = poly,
      IsPositive       = pos,
      Center           = center,
      Hole             = hole,
      BaseLeftPt       = bl,
      BaseRightPt      = br,
      TopLeftPt        = tl,
      TopRightPt       = tr,
      OriginalConnector= crv,
      ConnectorParam   = t
    };
  }

  private Polyline CreateLaserNodePolyline(
    Plane pl,
    double bw, double bh,
    double te, double wr,
    out Point3d bl, out Point3d br,
    out Point3d tl, out Point3d tr)
  {
    bl = br = tl = tr = Point3d.Unset;
    wr = RhinoMath.Clamp(wr, 0.01, 10.0);
    double halfB = bw / 2.0, halfT = halfB * wr;

    br = pl.PointAt( halfB, -bh/2.0 );
    tr = pl.PointAt( halfT,  bh/2.0 + te );
    tl = pl.PointAt(-halfT,  bh/2.0 + te );
    bl = pl.PointAt(-halfB, -bh/2.0 );

    var pts = new List<Point3d> { bl, tl, tr, br };
    var poly = new Polyline(pts);
    if (!poly.IsValid || poly.Length < _tolerance || poly.Count != 4) return null;
    return poly;
  }

  private List<Interval> CalculateFreeParameterIntervals(List<Interval> occupied, Interval dom)
  {
    var free = new List<Interval>();
    if (occupied == null || !occupied.Any())
    {
      if (dom.IsValid && dom.Length > _tolerance) free.Add(dom);
      return free;
    }
    var merged = MergeIntervals(occupied, _tolerance);
    double cur = dom.Min;
    foreach (var iv in merged)
    {
      double s = Math.Max(dom.Min, iv.Min), e = Math.Min(dom.Max, iv.Max);
      if (s > cur + _tolerance) free.Add(new Interval(cur, s));
      cur = Math.Max(cur, e);
    }
    if (cur < dom.Max - _tolerance) free.Add(new Interval(cur, dom.Max));
    return free;
  }

  private List<Interval> MergeIntervals(List<Interval> ints, double tol)
  {
    if (ints == null || ints.Count <= 1) return ints ?? new List<Interval>();
    var valid = ints.Where(i => i.IsValid).OrderBy(i => i.Min).ToList();
    var merged = new List<Interval> { valid[0] };
    foreach (var next in valid.Skip(1))
    {
      var last = merged.Last();
      if (next.Min <= last.Max + tol)
        merged[merged.Count - 1] = new Interval(last.Min, Math.Max(last.Max, next.Max));
      else
        merged.Add(next);
    }
    return merged;
  }

  private void AssociateSegmentsWithNodes(List<Line> segs, List<FabricationNodeData> nodes)
  {
    if (segs == null || nodes == null) return;
    double tolSq = _tolerance * _tolerance;
    foreach (var nd in nodes)
    {
      foreach (var s in segs)
      {
        if (!s.IsValid) continue;
        bool nearBL = s.From.DistanceToSquared(nd.BaseLeftPt) < tolSq || s.To.DistanceToSquared(nd.BaseLeftPt) < tolSq;
        bool nearBR = s.From.DistanceToSquared(nd.BaseRightPt) < tolSq || s.To.DistanceToSquared(nd.BaseRightPt) < tolSq;
        if ((nearBL || nearBR) && !nd.ConnectingSegments.Contains(s))
          nd.ConnectingSegments.Add(s);
      }
    }
  }

  private Curve CombineToothAndSegments(FabricationNodeData nd, double tol)
  {
    var tooth = nd.ToothPolyline;
    if (tooth == null || !tooth.IsValid || tooth.Count != 4) return null;
    double tolSq = tol * tol;
    var pBL = nd.BaseLeftPt;
    var pBR = nd.BaseRightPt;
    Line segL = Line.Unset, segR = Line.Unset;
    foreach (var s in nd.ConnectingSegments)
    {
      if (!s.IsValid) continue;
      bool fBL = s.From.DistanceToSquared(pBL) < tolSq, tBL = s.To.DistanceToSquared(pBL) < tolSq;
      bool fBR = s.From.DistanceToSquared(pBR) < tolSq, tBR = s.To.DistanceToSquared(pBR) < tolSq;
      if ((fBL || tBL) && !segL.IsValid) segL = s;
      if ((fBR || tBR) && !segR.IsValid) segR = s;
      if (segL.IsValid && segR.IsValid) break;
    }
    var pts = new List<Point3d>();
    if (segL.IsValid) pts.Add(segL.From.DistanceToSquared(pBL) < tolSq ? segL.To : segL.From);
    pts.Add(pBL);
    pts.Add(nd.TopLeftPt);
    pts.Add(nd.TopRightPt);
    pts.Add(pBR);
    if (segR.IsValid) pts.Add(segR.From.DistanceToSquared(pBR) < tolSq ? segR.To : segR.From);
    if (pts.Count < 2) return null;
    var pl = new Polyline(pts);
    if (!pl.IsValid || pl.Length < tol) return null;
    return new PolylineCurve(pl);
  }

  private Curve FilletCombinedNodeManual_PointBased(
    Curve cc, FabricationNodeData nd, double r, double tol, bool filletInner)
  {
    if (cc == null || !cc.IsValid || r <= tol) return cc;
    if (!cc.TryGetPolyline(out Polyline pl) || pl.Count < 3) return cc;

    Point3d pt1 = filletInner ? nd.BaseLeftPt : nd.TopLeftPt;
    Point3d pt2 = filletInner ? nd.BaseRightPt : nd.TopRightPt;
    var idxs = new List<int>();
    int i1 = pl.ClosestIndex(pt1);
    if (i1 > 0 && i1 < pl.Count - 1 && pl[i1].DistanceToSquared(pt1) < tol * tol) idxs.Add(i1);
    int i2 = pl.ClosestIndex(pt2);
    if (i2 > 0 && i2 < pl.Count - 1 && i2 != i1 && pl[i2].DistanceToSquared(pt2) < tol * tol) idxs.Add(i2);
    if (!idxs.Any()) return cc;
    idxs.Sort();

    var newPts = new List<Point3d> { pl[0] };
    int ptr = 0;
    for (int i = 1; i < pl.Count - 1; i++)
    {
      if (ptr < idxs.Count && i == idxs[ptr])
      {
        var corner = pl[i];
        var prev   = pl[i - 1];
        var next   = pl[i + 1];
        var v1 = prev - corner; var v2 = next - corner;
        double l1 = v1.Length, l2 = v2.Length;
        if (!v1.Unitize() || !v2.Unitize() || l1 < tol || l2 < tol) { newPts.Add(corner); ptr++; continue; }
        double ang = Vector3d.VectorAngle(v1, v2);
        if (ang < _angleTolerance || ang > Math.PI - _angleTolerance) { newPts.Add(corner); ptr++; continue; }
        double tanHalf = Math.Tan(ang / 2.0);
        if (Math.Abs(tanHalf) < tol) { newPts.Add(corner); ptr++; continue; }
        double off = r / tanHalf; off = Math.Min(off, l1 / 2.0); off = Math.Min(off, l2 / 2.0);
        if (off <= tol) { newPts.Add(corner); ptr++; continue; }
        var ptA = corner + v1 * off;
        var ptB = corner + v2 * off;
        var arc = new Arc(ptA, corner, ptB);
        if (arc.IsValid)
        {
          newPts.Add(ptA);
          var arcCrv = arc.ToNurbsCurve();
          int samples = Math.Min(20, Math.Max(3, (int)Math.Ceiling(arc.Length / (r * 0.5)) + 1));
          var ps = arcCrv.DivideByCount(samples, false);
          foreach (var t in ps)
          {
            var ap = arcCrv.PointAt(t);
            if (newPts.Last().DistanceTo(ap) > tol / 2) newPts.Add(ap);
          }
          if (newPts.Last().DistanceTo(ptB) > tol / 2) newPts.Add(ptB);
        }
        else newPts.Add(corner);
        ptr++;
      }
      else newPts.Add(pl[i]);
    }
    newPts.Add(pl.Last());
    if (newPts.Count < 2) return cc;
    var finalPl = new Polyline(newPts);
    if (!finalPl.IsValid || finalPl.Length < tol) return cc;
    return new PolylineCurve(finalPl);
  }

  /// <summary>
  /// Builds an arc extension from trimmed node‐end to the closest point on the connector.
  /// </summary>
  private Curve BuildFullSequenceForNode(
    FabricationNodeData nd,
    Curve nodeCrv,
    double connectingArcRadius,
    double tolerance,
    double arcTolerance)
  {
    if (nodeCrv == null || !nodeCrv.IsValid ||
        nd.OriginalConnector == null || !nd.OriginalConnector.IsValid)
      return nodeCrv;

    // Find connector parameters nearest to node‐curve endpoints
    Point3d nStart = nodeCrv.PointAtStart;
    Point3d nEnd   = nodeCrv.PointAtEnd;

    nd.OriginalConnector.ClosestPoint(nStart, out double tStart);
    Point3d startPt = nd.OriginalConnector.PointAt(tStart);

    nd.OriginalConnector.ClosestPoint(nEnd, out double tEnd);
    Point3d endPt   = nd.OriginalConnector.PointAt(tEnd);

    double gapStart = startPt.DistanceTo(nStart);
    double gapEnd   = endPt  .DistanceTo(nEnd);
    double threshold = Math.Max(tolerance * 10.0, connectingArcRadius * arcTolerance);

    if (gapStart >= gapEnd && gapStart > threshold)
    {
      var arc = CreateConnectingArc(startPt, nStart, nd.Center, connectingArcRadius, false, tolerance);
      if (arc != null && arc.IsValid)
      {
        var joined = Curve.JoinCurves(new[] { arc, nodeCrv }, tolerance * 1.5, true);
        if (joined != null && joined.Length > 0) return joined[0];
      }
    }
    else if (gapEnd > threshold)
    {
      var arc = CreateConnectingArc(nEnd, endPt, nd.Center, connectingArcRadius, false, tolerance);
      if (arc != null && arc.IsValid)
      {
        var joined = Curve.JoinCurves(new[] { nodeCrv, arc }, tolerance * 1.5, true);
        if (joined != null && joined.Length > 0) return joined[0];
      }
    }

    return nodeCrv;
  }

  /// <summary>
  /// Creates a pure arc bulging toward refPt, or null if invalid.
  /// </summary>
  private Curve CreateConnectingArc(
    Point3d start,
    Point3d end,
    Point3d refPt,
    double radius,
    bool createOutwardArc,
    double tolerance)
  {
    if (start.DistanceTo(end) < tolerance) return null;

    Point3d mid = (start + end) * 0.5;
    Vector3d dir = refPt - mid;
    if (!dir.Unitize()) dir = Vector3d.ZAxis;
    if (createOutwardArc) dir.Reverse();
    Point3d bulgePt = mid + dir * radius;

    Arc arc = new Arc(start, bulgePt, end);
    return arc.IsValid ? arc.ToNurbsCurve() : null;
  }

  private Curve TrimNodeCurve(Curve nodeCrv, Point3d bl, Point3d br, double tol)
  {
    if (nodeCrv == null || !nodeCrv.IsValid) return nodeCrv;
    var baseLine = new LineCurve(new Line(bl, br));
    var inters = Intersection.CurveCurve(nodeCrv, baseLine, tol, tol);
    if (inters != null && inters.Count >= 2)
    {
      var ps = inters.Where(i => i.IsPoint).Select(i => i.ParameterA).OrderBy(x => x).ToArray();
      var splits = nodeCrv.Split(ps);
      if (splits != null)
      {
        if (splits.Length == 3) return splits[1];
        if (splits.Length == 2)
        {
          double d0 = DistanceToLineAverage(splits[0], baseLine);
          double d1 = DistanceToLineAverage(splits[1], baseLine);
          return d0 < d1 ? splits[0] : splits[1];
        }
      }
    }
    return nodeCrv;
  }

  private double DistanceToLineAverage(Curve crv, LineCurve line)
  {
    line.ClosestPoint(crv.PointAtStart, out double t0);
    Point3d p0 = line.PointAt(t0);
    line.ClosestPoint(crv.PointAtEnd, out double t1);
    Point3d p1 = line.PointAt(t1);
    return (crv.PointAtStart.DistanceTo(p0) + crv.PointAtEnd.DistanceTo(p1)) * 0.5;
  }

  private List<Curve> TrimPrimaryEdges(List<Curve> edges, List<Curve> nodes, double tol)
  {
    var result = new List<Curve>();
    var comp = new ToleranceComparer(tol);

    foreach (var edge in edges)
    {
      if (edge == null || !edge.IsValid) continue;
      var parms = new List<double> { edge.Domain.Min, edge.Domain.Max };
      foreach (var nc in nodes)
      {
        if (nc == null || !nc.IsValid) continue;
        var inters = Intersection.CurveCurve(edge, nc, tol, tol);
        if (inters != null)
          parms.AddRange(inters.Where(i => i.IsPoint).Select(i => i.ParameterA));
      }
      var distinct = parms.Distinct(comp).OrderBy(x => x).ToArray();
      if (distinct.Length <= 2)
      {
        result.Add(edge.DuplicateCurve());
      }
      else
      {
        try
        {
          var parts = edge.Split(distinct);
          if (parts != null && parts.Length > 0)
            result.AddRange(parts.Where(s => s != null && s.IsValid && s.GetLength() > tol));
          else
            result.Add(edge.DuplicateCurve());
        }
        catch
        {
          result.Add(edge.DuplicateCurve());
        }
      }
    }

    return result;
  }

  private double EvaluateFitness(
    List<Line> connectors,
    List<Polyline> nodes,
    List<Curve> forbidden,
    Curve e1, Curve e2,
    List<Point3d> p1, List<Point3d> p2)
  {
    double tol = _tolerance, pen = 0.0;
    double minA = 88, maxA = 93;
    double fA = 0.1, fI = 10.0, fD = 0.2, fP = 0.2;
    double minD = 5.0, pTol = 5.0;

    int n = Math.Min(connectors.Count, Math.Min(p1.Count, p2.Count));
    for (int i = 0; i < n; i++)
    {
      var c = connectors[i]; if (!c.IsValid) continue;
      var dir = c.Direction; dir.Unitize();

      if (!e1.ClosestPoint(p1[i], out double t1, Math.Max(tol * 100, e1.GetLength() * 0.1))) continue;
      var tan1 = e1.TangentAt(t1); tan1.Unitize();

      if (!e2.ClosestPoint(p2[i], out double t2, Math.Max(tol * 100, e2.GetLength() * 0.1))) continue;
      var tan2 = e2.TangentAt(t2); tan2.Unitize();

      double a1 = RhinoMath.ToDegrees(Vector3d.VectorAngle(tan1, dir));
      double a2 = RhinoMath.ToDegrees(Vector3d.VectorAngle(tan2, dir));
      if (a1 > 90) a1 = 180 - a1;
      if (a2 > 90) a2 = 180 - a2;

      if (a1 < minA) pen += (minA - a1) * fA;
      else if (a1 > maxA) pen += (a1 - maxA) * fA;
      if (a2 < minA) pen += (minA - a2) * fA;
      else if (a2 > maxA) pen += (a2 - maxA) * fA;
    }

    var geo = new List<Curve>();
    geo.AddRange(connectors.Select(l => l.ToNurbsCurve()).Where(c => c != null && c.IsValid));
    geo.AddRange(nodes.Select(p => p.ToNurbsCurve()).Where(c => c != null && c.IsValid));

    foreach (var g in geo)
      foreach (var f in forbidden)
        if (f != null && f.IsValid)
        {
          var inters = Intersection.CurveCurve(g, f, tol, tol);
          if (inters != null && inters.Count > 0) pen += inters.Count * fI;
        }

    int samples = 10;
    foreach (var c in connectors)
    {
      var cc = c.ToNurbsCurve(); if (cc == null || !cc.IsValid) continue;
      var ps = cc.DivideByCount(samples - 1, true); if (ps == null) continue;
      foreach (var f in forbidden)
      {
        if (f == null || !f.IsValid) continue;
        double minSq = double.MaxValue, bestC = 0, bestF = 0;
        foreach (var tc in ps)
        {
          var pt = cc.PointAt(tc);
          if (f.ClosestPoint(pt, out double tf))
          {
            var fp = f.PointAt(tf);
            double d2 = pt.DistanceToSquared(fp);
            if (d2 < minSq) { minSq = d2; bestC = tc; bestF = tf; }
          }
        }
        double md = Math.Sqrt(minSq);
        if (md < minD) pen += (minD - md) * fD;
        var fTan = f.TangentAt(bestF); fTan.Unitize();
        var cTan = cc.TangentAt(bestC); cTan.Unitize();
        double ang = RhinoMath.ToDegrees(Vector3d.VectorAngle(fTan, cTan));
        if (ang > 90) ang = 180 - ang;
        double dev = Math.Abs(ang - 90);
        if (dev > pTol) pen += (dev - pTol) * fP;
      }
    }

    return Math.Max(0.0, pen);
  }

  private List<Line> CleanRawSegments(
    List<Line> rawSegs,
    List<Curve> nodeCurves,
    double threshold)
  {
    var outList = new List<Line>();
    foreach (var s in rawSegs)
    {
      if (!s.IsValid) continue;
      var mid = s.PointAt(0.5);
      bool discard = false;
      foreach (var nc in nodeCurves)
      {
        if (nc == null || !nc.IsValid) continue;
        if (nc.ClosestPoint(mid, out double t))
        {
          if (mid.DistanceTo(nc.PointAt(t)) < threshold)
          {
            discard = true;
            break;
          }
        }
      }
      if (!discard) outList.Add(s);
    }
    return outList;
  }
}
# ---------- end unixc_v55 ----------
curve_6 = Curve(unixc_v55.LongSeg)
curve_7 = Curve(unixc_v55.nodepart2)
curve_8 = Curve(unixc_v55.teeth)
curve_9 = Curve(unixc_v55.nodepart1)
curve_10 = Curve(unixc_v55.Circles)
point_2 = Point(unixc_v55.centres)
panel_7 = Panel(unixc_v55.instruction)
list_item_7 = ListItem(List=curve_6, Index=Slider(0, range=0..10), Wrap=True)
