# Grasshopper definition Example_IGD_Subx_SurfX_DiagonalX_C#_RafailKonstantinidis.gh (Grasshopper 1.0.8)
# plug-ins: Pufferfish, LunchBox

platonic_tetrahedron = PlatonicTetrahedron(Plane=PlaneXY(0, 0, 0), Radius=Slider(56, range=0..100), Truncation=0)
platonic_dodecahedron = PlatonicDodecahedron(Plane=PlaneXY(0, 0, 0), Radius=Slider(60, range=0..100))
rectangle = Rectangle(Plane=PlaneXY(0, 0, 0), XSize=Slider(65, range=0..100), YSize=Slider(65, range=0..100), Radius=0)  # -> Rectangle, Length
deconstruct_brep = DeconstructBrep(Brep=platonic_tetrahedron)  # -> Faces, Edges, Vertices
deconstruct_brep_2 = DeconstructBrep(Brep=platonic_dodecahedron)  # -> Faces, Edges, Vertices
box_rectangle = BoxRectangle(Rectangle=rectangle.Rectangle, Height=Slider(65, range=0..100))
deconstruct_brep_3 = DeconstructBrep(Brep=box_rectangle)  # -> Faces, Edges, Vertices
paralleloid = Curve(deconstruct_brep_3.Edges)

# ----
# SubX
number_slider = Slider(0.39, range=0..2)
c_script = CSharpScript(InputCurves=deconstruct_brep.Edges, LengthFactor=number_slider)  # -> out, OutputSegments; inputs InputCurves: list of Curve, LengthFactor: Double
# ---------- c_script: C# ----------
using System;
using System.Collections.Generic;
using Rhino;
using Rhino.Geometry;
using Rhino.Geometry.Intersect;

public class Script_Instance : GH_ScriptInstance
{
  /// <summary>
  /// For each input curve, the script finds the intersection (connection) nodes.
  /// Then, for each intersection node it creates two subcurves:
  /// one extending backward (left) from the node and one extending forward (right).
  /// The subcurve length is a fraction (LengthFactor) of the available segment length.
  /// </summary>
  /// <param name="InputCurves">
  /// A list of curves. These may be edges of polyhedra or similar shapes that meet at nodes.
  /// </param>
  /// <param name="LengthFactor">
  /// A factor (between 0 and 1) that determines how far along the available segment the subcurve will extend.
  /// For example, if LengthFactor is 0.5 then each subcurve will have half the length available from the node.
  /// </param>
  /// <param name="OutputSegments">
  /// The list of subcurves (connection nodes) generated from each intersection.
  /// </param>
  private void RunScript(
		List<Curve> InputCurves,
		double LengthFactor,
		ref object OutputSegments)
  {
    // This list will hold all the subcurves we generate.
    List<Curve> resultSegments = new List<Curve>();
    double tolerance = RhinoDoc.ActiveDoc.ModelAbsoluteTolerance;
    double minLength = tolerance * 10; // segments shorter than this are ignored

    // Validate input.
    if (InputCurves == null || InputCurves.Count == 0 || LengthFactor <= 0)
    {
      OutputSegments = resultSegments;
      return;
    }

    // Process each curve individually.
    foreach (Curve crv in InputCurves)
    {
      if (crv == null || !crv.IsValid)
      {
        Print("Skipped invalid curve");
        continue;
      }

      // 1. Find raw intersection parameters along this curve.
      //    (These come directly from CurveCurve intersections with every other curve.)
      List<double> rawIntersections = new List<double>();
      foreach (Curve other in InputCurves)
      {
        if (other == null || other == crv)
          continue;

        var events = Intersection.CurveCurve(crv, other, tolerance, tolerance);
        if (events != null)
        {
          foreach (var evt in events)
          {
            if (evt.IsPoint)
              rawIntersections.Add(evt.ParameterA);
          }
        }
      }

      // If no intersection nodes were found on this curve, skip it.
      if (rawIntersections.Count == 0)
        continue;

      // 2. Build a complete, sorted list of parameter values.
      //    For open curves we add the endpoints so we know the full extent.
      List<double> allParams = new List<double>(rawIntersections);
      if (!crv.IsClosed)
      {
        allParams.Add(crv.Domain.Min);
        allParams.Add(crv.Domain.Max);
      }
      // Remove near-duplicates and sort the list.
      allParams = CleanParameters(crv, allParams, tolerance);
      // Also clean the raw intersections list.
      rawIntersections = CleanParameters(crv, rawIntersections, tolerance);

      // 3. For each parameter in our sorted list that is an intersection node,
      //    create two subcurves (if possible): one to the left (backward) and one to the right (forward).
      for (int i = 0; i < allParams.Count; i++)
      {
        double p = allParams[i];
        bool isIntersection = false;
        // Determine if this parameter comes from an actual intersection.
        foreach (double r in rawIntersections)
        {
          if (Math.Abs(p - r) < tolerance)
          {
            isIntersection = true;
            break;
          }
        }
        if (!isIntersection)
          continue; // skip parameters that are just endpoints

        // --- Create the left (backward) subcurve ---
        // If there is a previous parameter, then the interval [prev, p] is available.
        if (i > 0)
        {
          Interval leftInterval = new Interval(allParams[i - 1], p);
          double segLength = crv.GetLength(leftInterval);
          if (segLength > minLength)
          {
            // Extract the subcurve covering the full left interval.
            Curve leftSegment = crv.Trim(leftInterval.Min, leftInterval.Max);
            if (leftSegment != null && leftSegment.IsValid)
            {
              // We want a subcurve starting at the intersection node.
              // Reverse the left segment so that the intersection (p) becomes the start.
              Curve reversedLeft = leftSegment.DuplicateCurve();
              reversedLeft.Reverse();
              double targetLength = segLength * LengthFactor;
              double tReversed;
              if (reversedLeft.LengthParameter(targetLength, out tReversed))
              {
                Curve trimmedReversed = reversedLeft.Trim(reversedLeft.Domain.Min, tReversed);
                if (trimmedReversed != null && trimmedReversed.IsValid)
                {
                  // Reverse back to restore the original orientation.
                  trimmedReversed.Reverse();
                  resultSegments.Add(trimmedReversed);
                }
              }
            }
          }
        }

        // --- Create the right (forward) subcurve ---
        // If there is a next parameter, then the interval [p, next] is available.
        if (i < allParams.Count - 1)
        {
          Interval rightInterval = new Interval(p, allParams[i + 1]);
          double segLength = crv.GetLength(rightInterval);
          if (segLength > minLength)
          {
            Curve rightSegment = crv.Trim(rightInterval.Min, rightInterval.Max);
            if (rightSegment != null && rightSegment.IsValid)
            {
              double targetLength = segLength * LengthFactor;
              double tEnd;
              if (rightSegment.LengthParameter(targetLength, out tEnd))
              {
                Curve trimmed = rightSegment.Trim(rightSegment.Domain.Min, tEnd);
                if (trimmed != null && trimmed.IsValid)
                {
                  resultSegments.Add(trimmed);
                }
              }
            }
          }
        }
      }
    }

    OutputSegments = resultSegments;
  }

  /// <summary>
  /// Removes near-duplicate parameter values (within tolerance) and sorts them.
  /// Only parameters within the curve’s domain are kept.
  /// </summary>
  /// <param name="crv">The curve whose domain is considered.</param>
  /// <param name="parameters">List of parameter values.</param>
  /// <param name="tolerance">Tolerance for considering two parameters as duplicates.</param>
  /// <returns>A sorted list of unique parameter values.</returns>
  private List<double> CleanParameters(Curve crv, List<double> parameters, double tolerance)
  {
    List<double> cleaned = new List<double>();
    parameters.Sort();
    foreach (double t in parameters)
    {
      if (!crv.Domain.IncludesParameter(t))
        continue;
      bool duplicate = false;
      foreach (double exist in cleaned)
      {
        if (Math.Abs(t - exist) < tolerance)
        {
          duplicate = true;
          break;
        }
      }
      if (!duplicate)
        cleaned.Add(t);
    }
    return cleaned;
  }
}
# ---------- end c_script ----------

geometry = Geometry(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)  # disabled
geometry_2 = Geometry(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)  # disabled

curve = Curve(deconstruct_brep_2.Edges)

# ----
# SubX
number_slider_2 = Slider(0.18, range=0..1)  # disabled
c_script_2 = CSharpScript(InputCurves=deconstruct_brep_2.Edges, LengthFactor=number_slider_2)  # -> out, OutputSegments; inputs InputCurves: list of Curve, LengthFactor: Double; disabled; same code as c_script

# ----
# Surfx
boolean_toggle = BooleanToggle(False)
c_script_3 = CSharpScript(inputCurves=c_script.OutputSegments, linearizeEdges=boolean_toggle, flipNext=Toggle(True))  # -> out, A; inputs inputCurves: list of Curve, tolerance: Double, linearizeEdges: Boolean, flipNext: Boolean, rebuildU: Int32, rebuildV: Int32
# ---------- c_script_3: C# ----------
using System;
using System.Collections.Generic;
using Rhino;
using Rhino.Geometry;
using Rhino.Geometry.Intersect;

public class Script_Instance : GH_ScriptInstance
{
  // New inputs: rebuildU and rebuildV for rebuilding factors; flipNext to optionally flip next curve.
  private void RunScript(
		List<Curve> inputCurves,
		double tolerance,
		bool linearizeEdges,
		bool flipNext,
		int rebuildU,
		int rebuildV,
		ref object A)
  {
    List<Brep> generatedSurfaces = new List<Brep>();

    if (inputCurves == null || inputCurves.Count < 2)
    {
      A = generatedSurfaces;
      return;
    }

    // Group curves that share intersections
    List<List<Curve>> groupedCurves = GroupCurvesByIntersection(inputCurves, tolerance);

    foreach (List<Curve> group in groupedCurves)
    {
      // For groups with 3 or more curves, order them circularly to form a closed loop.
      List<Curve> orderedCurves = OrderCurvesByIntersections(group, tolerance);
      int curveCount = orderedCurves.Count;
      
      // Loop through each pair using wrap-around (last pairs with first)
      for (int i = 0; i < curveCount; i++)
      {
        Curve curve1 = orderedCurves[i];
        Curve curve2 = orderedCurves[(i + 1) % curveCount];

        // Loft only if the curves actually intersect.
        var intersections = Intersection.CurveCurve(curve1, curve2, tolerance, tolerance);
        if (intersections == null || intersections.Count == 0)
          continue;

        Point3d interPt = intersections[0].PointA;
        curve1 = OrientCurveRelativeToIntersection(curve1, interPt, true, tolerance);
        curve2 = OrientCurveRelativeToIntersection(curve2, interPt, false, tolerance);
        
        // Optionally flip the next curve.
        curve2 = ApplyFlip(curve2, flipNext);

        // Create loft surface between the two curves.
        Brep[] loftSurface = Brep.CreateFromLoft(
          new List<Curve> { curve1, curve2 },
          Point3d.Unset,
          Point3d.Unset,
          LoftType.Normal,
          false
        );
        Brep finalSurface = GetJoinedSurface(loftSurface, tolerance);

        // Fallback to a straight loft if needed.
        if (finalSurface == null || !finalSurface.IsValid)
        {
          loftSurface = Brep.CreateFromLoft(
            new List<Curve> { curve1, curve2 },
            Point3d.Unset,
            Point3d.Unset,
            LoftType.Straight,
            false
          );
          finalSurface = GetJoinedSurface(loftSurface, tolerance);
        }

        // Optimize the surface quality by reparameterizing it using rebuildU and rebuildV.
        if (finalSurface != null && finalSurface.IsValid)
        {
          finalSurface = OptimizeSurfaceQuality(finalSurface, rebuildU, rebuildV, tolerance);
          generatedSurfaces.Add(finalSurface);
        }
      }
    }

    A = generatedSurfaces;
  }

  /// <summary>
  /// Optionally reverses the curve if flip is true.
  /// </summary>
  private Curve ApplyFlip(Curve curve, bool flip)
  {
    if (flip)
      curve.Reverse();
    return curve;
  }

  /// <summary>
  /// Joins lofted Breps (if more than one) and returns the first valid joined surface.
  /// </summary>
  private Brep GetJoinedSurface(Brep[] loftBreps, double tolerance)
  {
    if (loftBreps == null || loftBreps.Length == 0)
      return null;
    if (loftBreps.Length == 1)
      return loftBreps[0];

    Brep[] joined = Brep.JoinBreps(loftBreps, tolerance);
    if (joined != null && joined.Length > 0)
      return joined[0];
    return null;
  }

  /// <summary>
  /// Reparameterizes the first face of the Brep for improved surface quality.
  /// Forces the U and V domains to a slightly shrunken interval to avoid singular trimming domains.
  /// </summary>
  private Brep OptimizeSurfaceQuality(Brep brep, int rebuildU, int rebuildV, double tol)
  {
    if (brep == null || !brep.IsValid || brep.Faces.Count == 0)
      return brep;
    
    Surface srf = brep.Faces[0].DuplicateSurface();
    NurbsSurface nurbsSrf = srf.ToNurbsSurface();
    if (nurbsSrf == null || !nurbsSrf.IsValid)
      return brep;
    
    // Rebuild the surface with degree 3 in both directions using the provided factors.
    NurbsSurface rebuilt = nurbsSrf.Rebuild(3, 3, rebuildU, rebuildV);
    if (rebuilt == null || !rebuilt.IsValid)
      return brep;
    
    // Use a small epsilon (at least as big as tolerance) to shrink the domain.
    double eps = Math.Max(tol, 1e-3);
    rebuilt.SetDomain(0, new Interval(eps, 1 - eps));
    rebuilt.SetDomain(1, new Interval(eps, 1 - eps));
    
    // Validate the new domains.
    Interval newUDom = rebuilt.Domain(0);
    Interval newVDom = rebuilt.Domain(1);
    if (Math.Abs(newUDom.Length) < tol || Math.Abs(newVDom.Length) < tol)
      return brep; // Still degenerate, so return the original.
    
    Brep newBrep = Brep.CreateFromSurface(rebuilt);
    if (newBrep != null && newBrep.IsValid)
      return newBrep;
    
    return brep;
  }

  /// <summary>
  /// Reverses the curve if necessary so that the intersection point is at the desired end.
  /// </summary>
  private Curve OrientCurveRelativeToIntersection(Curve curve, Point3d intersectionPoint, bool intersectionAtStart, double tol)
  {
    double dStart = curve.PointAtStart.DistanceTo(intersectionPoint);
    double dEnd = curve.PointAtEnd.DistanceTo(intersectionPoint);

    if ((intersectionAtStart && dStart > dEnd + tol) || (!intersectionAtStart && dEnd > dStart + tol))
      curve.Reverse();

    return curve;
  }

  /// <summary>
  /// Groups curves that share intersections within a tolerance.
  /// </summary>
  private List<List<Curve>> GroupCurvesByIntersection(List<Curve> curves, double tolerance)
  {
    List<List<Curve>> groups = new List<List<Curve>>();
    HashSet<Curve> visited = new HashSet<Curve>();

    foreach (Curve curve in curves)
    {
      if (visited.Contains(curve))
        continue;

      Queue<Curve> queue = new Queue<Curve>();
      List<Curve> group = new List<Curve>();

      queue.Enqueue(curve);
      visited.Add(curve);

      while (queue.Count > 0)
      {
        Curve current = queue.Dequeue();
        group.Add(current);

        foreach (Curve candidate in curves)
        {
          if (!visited.Contains(candidate) &&
              Intersection.CurveCurve(current, candidate, tolerance, tolerance).Count > 0)
          {
            queue.Enqueue(candidate);
            visited.Add(candidate);
          }
        }
      }
      groups.Add(group);
    }
    return groups;
  }

  /// <summary>
  /// Orders curves based on intersections. For groups with three or more curves, a circular order is used.
  /// </summary>
  private List<Curve> OrderCurvesByIntersections(List<Curve> curves, double tolerance)
  {
    if (curves.Count >= 3)
      return OrderCurvesCircular(curves);
    else
      return new List<Curve>(curves);
  }

  /// <summary>
  /// Orders curves in a circular fashion based on the angles of their midpoints relative to their centroid.
  /// </summary>
  private List<Curve> OrderCurvesCircular(List<Curve> curves)
  {
    List<Curve> sortedCurves = new List<Curve>(curves);
    List<Point3d> midpoints = new List<Point3d>();

    foreach (Curve curve in sortedCurves)
      midpoints.Add(curve.PointAtNormalizedLength(0.5));

    Point3d centroid = new Point3d(0, 0, 0);
    foreach (Point3d pt in midpoints)
      centroid += pt;
    centroid /= midpoints.Count;

    sortedCurves.Sort((a, b) =>
    {
      Point3d ma = a.PointAtNormalizedLength(0.5);
      Point3d mb = b.PointAtNormalizedLength(0.5);
      double angleA = Math.Atan2(ma.Y - centroid.Y, ma.X - centroid.X);
      double angleB = Math.Atan2(mb.Y - centroid.Y, mb.X - centroid.X);
      return angleA.CompareTo(angleB);
    });
    return sortedCurves;
  }
}
# ---------- end c_script_3 ----------

# ----
# Simple connection pipes
join_curves = JoinCurves(Curves=flatten(curve), Preserve=False)  # disabled
number_slider_3 = Slider(0.31, range=0..10)  # disabled
number_slider_4 = Slider(1.23, range=0..10)  # disabled
number_slider_5 = Slider(0.47, range=0..10)  # disabled
number_slider_6 = Slider(1, range=0..1)  # disabled
multipipe = MultiPipe(
    Curves=c_script_2.OutputSegments,
    NodeSize=number_slider_4,
    EndOffset=1,
    StrutSize=number_slider_5,
    Segment=0,
    KinkAngle=0.6,
    CubeFit=0,
    Caps=number_slider_6)  # disabled
pipe = Pipe(Curve=join_curves, Radius=number_slider_3, Caps=0)  # disabled
solid_difference = SolidDifference(BrepsA=graft(multipipe), BrepsB=pipe)  # disabled
move = Move(Geometry=solid_difference, Motion=Vector(0, 0, 10))  # -> Geometry, Transform; disabled

# ----
# SubX
number_slider_7 = Slider(0.43, range=0..1)
c_script_4 = CSharpScript(InputCurves=paralleloid, LengthFactor=number_slider_7)  # -> out, OutputSegments; inputs InputCurves: list of Curve, LengthFactor: Double; same code as c_script
panel = Panel(c_script_4.OutputSegments)

number_slider_8 = Slider(1, range=0..10)  # disabled
brep_join = BrepJoin(Breps=c_script_3.A)  # -> Breps, Closed; disabled
negative = Negative(Value=number_slider_8)  # disabled
offset_surface = OffsetSurface(Surface=brep_join.Breps, Distance=number_slider_8, BothSides=negative, CreateSolid=True)  # disabled

number_slider_9 = Slider(2, range=0..10)
divide_domain² = DivideDomain²(Domain=c_script_3.A, UCount=number_slider_9, VCount=number_slider_9)
isotrim = Isotrim(Surface=graft(c_script_3.A), Domain=divide_domain²)
join_curves_2 = JoinCurves(Curves=flatten(isotrim), Preserve=False)
curve_to_polyline = CurveToPolyline(Curve=join_curves_2, ToleranceDistance=0, ToleranceAngle=0)  # -> Polyline, Segments

# ----
# MidX
number_slider_10 = Slider(0.27, range=0..1)
c_script_5 = CSharpScript(InputCurves=paralleloid, LengthFactor=number_slider_10)  # -> out, OutputSegments; inputs InputCurves: list of Curve, LengthFactor: Double
# ---------- c_script_5: C# ----------
using System;
using System.Collections.Generic;
using Rhino;
using Rhino.Geometry;
using Rhino.Geometry.Intersect;

public class Script_Instance : GH_ScriptInstance
{
    private void RunScript(
		List<Curve> InputCurves,
		double LengthFactor,
		ref object OutputSegments)
    {
        // Initialize output
        List<Curve> resultSegments = new List<Curve>();
        double tolerance = RhinoDoc.ActiveDoc.ModelAbsoluteTolerance;
        
        // Process each curve
        foreach (Curve crv in InputCurves)
        {
            if (crv == null || !crv.IsValid) continue;

            List<double> splitParams = new List<double>();

            // Find intersections with all other curves
            foreach (Curve otherCrv in InputCurves)
            {
                if (crv == otherCrv) continue;
                
                var intersections = Intersection.CurveCurve(crv, otherCrv, tolerance, tolerance);
                foreach (var intersection in intersections)
                {
                    if (intersection.IsPoint)
                    {
                        splitParams.Add(intersection.ParameterA);
                    }
                }
            }

            // Add curve endpoints and sort
            splitParams.Add(crv.Domain.Min);
            splitParams.Add(crv.Domain.Max);
            splitParams.Sort();

            // Split and process segments
            Curve[] segments = crv.Split(splitParams);
            foreach (Curve segment in segments)
            {
                if (segment == null || segment.GetLength() < tolerance) continue;

                // Create scaled segment
                Curve scaled = ScaleSegmentFromCenter(segment, LengthFactor);
                if (scaled != null && scaled.IsValid)
                {
                    resultSegments.Add(scaled);
                }
            }
        }

        OutputSegments = resultSegments;
    }

    private Curve ScaleSegmentFromCenter(Curve segment, double factor)
    {
        // Scale segment length while keeping center position
        double originalLength = segment.GetLength();
        double newLength = originalLength * factor;
        
        if (newLength < RhinoMath.ZeroTolerance)
            return null;

        double trimAmount = (originalLength - newLength) / 2;
        
        if (segment.LengthParameter(trimAmount, out double tStart) &&
            segment.LengthParameter(originalLength - trimAmount, out double tEnd))
        {
            return segment.Trim(tStart, tEnd);
        }
        
        return segment.DuplicateCurve();
    }
}
# ---------- end c_script_5 ----------

# ----
# DiagonalX
boolean_toggle_2 = BooleanToggle(False)
c_script_6 = CSharpScript(
    InputSegments=c_script_4.OutputSegments,
    SubdivisionCount=Slider(1, range=0..10),
    AsymSubdivision=boolean_toggle_2,
    BetweenTrussSubdivisionCount=Slider(1, range=0..10))  # -> out, FractalPoints, TrussBeams; inputs InputSegments: list of Curve, SubdivisionCount: Int32, FractalFactor: Double, AsymSubdivision: Boolean, BetweenTrussSubdivisionCount: Int32
# ---------- c_script_6: C# ----------
using System;
using System.Collections.Generic;
using Rhino;
using Rhino.Geometry;
using System.Linq;

public class Script_Instance : GH_ScriptInstance
{
    private void RunScript(
		List<Curve> InputSegments,
		int SubdivisionCount,
		double FractalFactor,
		bool AsymSubdivision,
		int BetweenTrussSubdivisionCount,
		ref object FractalPoints,
		ref object TrussBeams)
    {
        double tol = RhinoDoc.ActiveDoc.ModelAbsoluteTolerance;

        // Collect all curve endpoints
        List<Point3d> allEndpoints = InputSegments
            .Where(c => c != null && c.IsValid)
            .SelectMany(c => new[] { c.PointAtStart, c.PointAtEnd })
            .ToList();

        // Cluster endpoints into unique nodes using tolerance
        List<Point3d> nodes = new List<Point3d>();
        foreach (Point3d pt in allEndpoints)
        {
            if (!nodes.Any(n => n.DistanceTo(pt) < tol))
                nodes.Add(pt);
        }

        // Group curves by their connected nodes
        Dictionary<Point3d, List<Curve>> groups = new Dictionary<Point3d, List<Curve>>(new Point3dComparer(tol));
        foreach (Point3d node in nodes)
        {
            List<Curve> connectedCurves = InputSegments
                .Where(c => c != null && c.IsValid &&
                    (c.PointAtStart.DistanceTo(node) < tol || c.PointAtEnd.DistanceTo(node) < tol))
                .ToList();
            if (connectedCurves.Count > 0)
                groups[node] = connectedCurves;
        }

        // Process groups and generate fractal points/beams
        List<List<List<Point3d>>> groupFractalPoints = new List<List<List<Point3d>>>();
        List<Curve> beams = new List<Curve>();

        foreach (var group in groups)
        {
            Point3d node = group.Key;
            List<Curve> curves = group.Value;

            // Orient curves so that the start is at the node
            foreach (Curve crv in curves)
            {
                if (crv.PointAtEnd.DistanceTo(node) < tol)
                    crv.Reverse();
            }

            // Generate fractal points for each curve in the group
            List<List<Point3d>> curvePoints = curves
                .Select(c => GenerateFractalPoints(c, SubdivisionCount, FractalFactor, AsymSubdivision, tol))
                .ToList();
            groupFractalPoints.Add(curvePoints);

            // Create main beams connecting corresponding fractal points
            if (curvePoints.Count > 1)
            {
                int minPoints = curvePoints.Min(c => c.Count);
                for (int i = 0; i < minPoints; i++)
                {
                    for (int j = 0; j < curvePoints.Count; j++)
                    {
                        for (int k = j + 1; k < curvePoints.Count; k++)
                        {
                            Point3d ptA = curvePoints[j][i];
                            Point3d ptB = curvePoints[k][i];
                            if (ptA.DistanceTo(ptB) > tol)
                                beams.Add(new LineCurve(ptA, ptB));
                        }
                    }
                }

                // Additional subdivision of the truss beams:
                // For each adjacent pair of fractal nodes on the curves,
                // subdivide the segment and add extra diagonal beams on both sides (X-shape)
                if (BetweenTrussSubdivisionCount > 0 && minPoints >= 2)
                {
                    for (int i = 0; i < minPoints - 1; i++)
                    {
                        for (int j = 0; j < curvePoints.Count; j++)
                        {
                            for (int k = j + 1; k < curvePoints.Count; k++)
                            {
                                Point3d A = curvePoints[j][i];
                                Point3d B = curvePoints[j][i + 1];
                                Point3d C = curvePoints[k][i];
                                Point3d D = curvePoints[k][i + 1];

                                // Subdivide each segment into (BetweenTrussSubdivisionCount + 2) points (including endpoints)
                                List<Point3d> subSeg1 = SubdivideLine(A, B, BetweenTrussSubdivisionCount + 2);
                                List<Point3d> subSeg2 = SubdivideLine(C, D, BetweenTrussSubdivisionCount + 2);

                                for (int s = 1; s < subSeg1.Count - 1; s++)
                                {
                                    // Connect corresponding subdivision points
                                    Point3d P = subSeg1[s];
                                    Point3d Q = subSeg2[s];
                                    if (P.DistanceTo(Q) > tol)
                                        beams.Add(new LineCurve(P, Q));

                                    // Create X-diagonals: connect subSeg1[s] to subSeg2[s+1]...
                                    if (s + 1 < subSeg1.Count)
                                    {
                                        Line diag1 = new Line(subSeg1[s], subSeg2[s + 1]);
                                        if (diag1.Length > tol)
                                            beams.Add(new LineCurve(diag1));
                                    }
                                    // ...and connect subSeg1[s+1] to subSeg2[s]
                                    if (s + 1 < subSeg2.Count)
                                    {
                                        Line diag2 = new Line(subSeg1[s + 1], subSeg2[s]);
                                        if (diag2.Length > tol)
                                            beams.Add(new LineCurve(diag2));
                                    }
                                }
                            }
                        }
                    }
                }
            }
        }

        // Assign outputs
        FractalPoints = groupFractalPoints;
        TrussBeams = beams;
    }

    private List<Point3d> GenerateFractalPoints(Curve crv, int subdivCount, double fractalFactor, bool asym, double tol)
    {
        List<Point3d> pts = new List<Point3d>();
        double tStart = crv.Domain.Min;
        double tEnd = crv.Domain.Max;

        pts.Add(crv.PointAt(tStart)); // Start at the node

        if (!asym)
        {
            // Even subdivision across the entire curve
            for (int i = 1; i <= subdivCount; i++)
            {
                double t = tStart + (tEnd - tStart) * (i / (double)subdivCount);
                ProcessPoint(crv, t, fractalFactor, tol, pts);
            }
        }
        else
        {
            // Asymmetrical subdivision starting from the midpoint
            double tMid = tStart + 0.5 * (tEnd - tStart);
            pts.Add(crv.PointAt(tMid));
            for (int i = 1; i <= subdivCount; i++)
            {
                double t = tMid + (tEnd - tMid) * (i / (double)subdivCount);
                ProcessPoint(crv, t, fractalFactor, tol, pts);
            }
        }

        pts.Add(crv.PointAt(tEnd)); // Always add the endpoint
        return pts;
    }

    private void ProcessPoint(Curve crv, double t, double fractalFactor, double tol, List<Point3d> pts)
    {
        Point3d pt = crv.PointAt(t);
        if (crv.PerpendicularFrameAt(t, out Plane frame))
        {
            // Use the YAxis as a perpendicular direction
            Vector3d perp = frame.YAxis;
            double offset = fractalFactor * crv.GetLength() * 0.1;
            pt += perp * offset * (pts.Count % 2 == 0 ? 1 : -1);
        }
        pts.Add(pt);
    }

    private List<Point3d> SubdivideLine(Point3d A, Point3d B, int count)
    {
        List<Point3d> pts = new List<Point3d>();
        for (int i = 0; i < count; i++)
        {
            double t = i / (double)(count - 1);
            pts.Add(A + (B - A) * t);
        }
        return pts;
    }

    private class Point3dComparer : IEqualityComparer<Point3d>
    {
        private readonly double _tolerance;
        public Point3dComparer(double tolerance) => _tolerance = tolerance;

        public bool Equals(Point3d p1, Point3d p2) => p1.DistanceTo(p2) <= _tolerance;
        
        public int GetHashCode(Point3d p)
        {
            return Math.Round(p.X / _tolerance).GetHashCode() ^
                   Math.Round(p.Y / _tolerance).GetHashCode();
        }
    }
}
# ---------- end c_script_6 ----------

explode = Explode(Curve=join_curves_2, Recursive=True)  # -> Segments, Vertices
list_item = ListItem(List=explode.Vertices, Index=0, Wrap=True)  # -> Item, Item1, Item2, Item3
removeduplicatepts = RemoveDuplicatePts(Points=explode.Vertices, Tolerance=0.01)
plane_3pt = Plane3Pt(PointA=list_item.Item, PointB=list_item.Item1, PointC=list_item.Item3)
clean_tree = CleanTree(RemoveNulls=True, RemoveInvalid=True, RemoveEmpty=False, Tree=plane_3pt)
list_item_2 = ListItem(List=removeduplicatepts, Index=Slider(1, range=0..10), Wrap=True)
circle_cnr = CircleCNR(Center=list_item_2, Normal=clean_tree, Radius=Slider(0.3, range=0..1))
dispatch = Dispatch(List=flatten(circle_cnr), DispatchPattern=[True, False])  # -> ListA, ListB
curve_2 = Curve(dispatch.ListA)
number_slider_11 = Slider(2.61, range=0..10)
boundary_surfaces = BoundarySurfaces(Edges=curve_2)
negative_2 = Negative(Value=number_slider_11)
offset_surface_2 = OffsetSurface(Surface=boundary_surfaces, Distance=number_slider_11, BothSides=negative_2, CreateSolid=True)

number_slider_12 = Slider(0.42, range=0..1)
number_slider_13 = Slider(0.9, range=0..10)
number_slider_14 = Slider(0.68, range=0..1)
multipipe_2 = MultiPipe(
    Curves=curve_to_polyline.Polyline,
    NodeSize=Slider(1, range=0..1),
    EndOffset=1,
    StrutSize=Slider(0.74, range=0..1),
    Segment=0,
    KinkAngle=0.6,
    CubeFit=0,
    Caps=0)

# ----
# MidX
number_slider_15 = Slider(0.35, range=0..1)
c_script_7 = CSharpScript(InputCurves=deconstruct_brep.Edges, LengthFactor=number_slider_15)  # -> out, OutputSegments; inputs InputCurves: list of Curve, LengthFactor: Double; same code as c_script_5

volume = Volume(Geometry=box_rectangle)  # -> Volume, Centroid
curve_middle = CurveMiddle(Curve=c_script_5.OutputSegments)
pipe_2 = Pipe(Curve=c_script_5.OutputSegments, Radius=Slider(0.54, range=0..1), Caps=0)  # -> flatten(Pipe)
vector_2pt = Vector2Pt(PointA=volume.Centroid, PointB=curve_middle, Unitize=False)  # -> Vector, Length
amplitude = Amplitude(Vector=vector_2pt.Vector, Amplitude=Slider(1.48, range=0..3))
negative_3 = Negative(Value=amplitude)

volume_2 = Volume(Geometry=platonic_tetrahedron)  # -> Volume, Centroid
curve_middle_2 = CurveMiddle(Curve=c_script_7.OutputSegments)
pipe_3 = Pipe(Curve=c_script_7.OutputSegments, Radius=Slider(0.33, range=0..1), Caps=0)  # -> flatten(Pipe)
vector_2pt_2 = Vector2Pt(PointA=volume_2.Centroid, PointB=curve_middle_2, Unitize=False)  # -> Vector, Length
amplitude_2 = Amplitude(Vector=vector_2pt_2.Vector, Amplitude=Slider(0, range=0..5))
negative_4 = Negative(Value=amplitude_2)
move_2 = Move(Geometry=pipe_3, Motion=negative_4)  # -> Geometry, Transform

number_slider_16 = Slider(0.56, range=0..1)
geometry_3 = Geometry(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)  # disabled

multipipe_3 = MultiPipe(
    Curves=c_script_6.TrussBeams,
    NodeSize=Slider(1.31, range=0..3),
    EndOffset=1,
    StrutSize=Slider(1, range=0..1),
    Segment=0,
    KinkAngle=Slider(3.8, range=0..10),
    CubeFit=Slider(0.41, range=0..1),
    Caps=0)
move_3 = Move(Geometry=pipe_2, Motion=negative_3)  # -> Geometry, Transform

geometry_4 = Geometry(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)  # disabled
# DiagonalX connecting nodes
panel_2 = Panel(c_script_6.TrussBeams)
geometry_5 = Geometry(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)  # disabled
colour_swatch = ColourSwatch(SwatchColor=RGB(115, 5, 5))  # disabled
colour_swatch_2 = ColourSwatch(SwatchColor=RGB(103, 113, 128))  # disabled
custom_preview = CustomPreview(Geometry=move_3.Geometry, Material=colour_swatch)  # disabled
custom_preview_2 = CustomPreview(Geometry=multipipe_3, Material=colour_swatch_2)  # disabled

colour_swatch_3 = ColourSwatch(SwatchColor=RGB(64, 42, 42))  # disabled
custom_preview_3 = CustomPreview(Geometry=move_2.Geometry, Material=colour_swatch_3)  # disabled

# ----
# SurfX connecting nodes
brep = Brep(offset_surface_2)
brep_join_2 = BrepJoin(Breps=flatten(brep))  # -> Breps, Closed
solid_union = SolidUnion(Breps=brep_join_2.Breps)
connection_nodes = Brep(multipipe_2)
connecting_pipes = Brep(move_2.Geometry)
screws = Brep(solid_union)
solid_difference_2 = SolidDifference(BrepsA=flatten(connection_nodes), BrepsB=graft(connecting_pipes))  # disabled
solid_difference_3 = SolidDifference(BrepsA=flatten(solid_difference_2))  # disabled
